# Dynamo custom node AboutCrumple.dyf "© About.Crumple" (Dynamo 2.3.0.5885)
# category: Crumple.Query
# About the package.
# packages: Crumple 2021.3.31

runMe = Input(runMe: bool)
string = StringInput("\n")
code_block = CodeBlock(refresh=runMe, nl=string)
# ---------- code_block.designscript (11 lines) ----------
refresh;

"About Crumple for Dynamo";

l1 = "Hi there! Thanks for installing Crumple.";
l2 = "This package is managed by Gavin Crump, known by some as the Aussie BIM Guru. From time to time I'll add nodes to this package, which I personally use for my own workflows and videos. I keep all my nodes nice and open, so you can see what goes on inside them!";
l3 = "If you have any bug reports or questions, I can be reached at aussiebimguru@gmail.com";

l1 + nl+""+nl + l2 + nl+""+nl + l3;

"Enjoy!";
# ----------------------------------------
uimessenger = Custom[© UIMessenger](title=code_block.out1, body=code_block.out5, pass=code_block.out6)  # package Crumple; Displays a message box with a title/body and OK/cancel button. If OK is selected, the third input's data will be passed through.
Output = Output(uimessenger)  # "=)"
