# Dynamo custom node AreasCreateSeparators.dyf "© Areas.CreateSeparators" (Dynamo 2.12.1.8246)
# category: Crumple.Revit.Create
# Given a list of Dynamo curves, the node generates area boundary lines along them in the given view. For convenience of iterability, this node flattens the curve list by default.

curves = Input(curves: var[]..[])  # Curves to base the area separation lines from.
flatten = List.Flatten(list=curves)
view = Input(view: var = Revit.Application.Document.Current.ActiveView)  # The view to place the lines in.
python_script = Python(IN[0]=flatten, IN[1]=view)  # IronPython2
# ---------- python_script.python (51 lines) ----------
# Made by Gavin Crump
# Free for use
# BIM Guru, www.bimguru.com.au

# Boilerplate text
import clr

clr.AddReference("RevitNodes")
import Revit
clr.ImportExtensions(Revit.Elements)
clr.ImportExtensions(Revit.GeometryConversion)

clr.AddReference("RevitServices")
import RevitServices
from RevitServices.Persistence import DocumentManager 
from RevitServices.Transactions import TransactionManager 

clr.AddReference("RevitAPI")
import Autodesk 
from Autodesk.Revit.DB import SketchPlane

# Current doc/app/ui
doc = DocumentManager.Instance.CurrentDBDocument

# Preparing input from dynamo to revit
curves_list = [IN[0]]
view_r      = UnwrapElement(IN[1])

# Start making Transaction
TransactionManager.Instance.EnsureInTransaction(doc)

# Make sketchplane at level of view
level_r = view_r.GenLevel
plane_r = SketchPlane.Create(doc, level_r.Id)

# Make area boundary lines from curves
bounds = []

for curves in curves_list:
	bound = []
	for curve in curves:
		crv = curve.ToRevitType()
		line = doc.Create.NewAreaBoundaryLine(plane_r, crv, view_r)
		bound.append(line.ToDSType(False))
	bounds.append(bound)
		
# Finish making transaction
TransactionManager.Instance.TransactionTaskDone()

# Preparing output to Dynamo
OUT = bounds
# ----------------------------------------
areas = Output(python_script)  # The model curves as elements.
