# Dynamo custom node CADImports.dyf "© CADImports" (Dynamo 2.3.0.5885)
# category: Crumple.Revit.LinkedFiles
# Returns all CAD import instances as well as their type and view.

Refresh = Input(Refresh: bool = true)
python_script = Python(IN[0]=Refresh)
# ---------- python_script.python (38 lines) ----------
# Made by Gavin Crump
# Free for use
# BIM Guru, www.bimguru.com.au

# Boilerplate text
import clr

clr.AddReference("RevitServices")
import RevitServices
from RevitServices.Persistence import DocumentManager

clr.AddReference("RevitNodes")
import Revit
clr.ImportExtensions(Revit.Elements)

clr.AddReference("RevitAPI")
import Autodesk
from Autodesk.Revit.DB import *

doc = DocumentManager.Instance.CurrentDBDocument

# Collect all imports
col = FilteredElementCollector(doc).OfClass(ImportInstance).ToElements()

# Get instance properties
cadImp, cadImpType, cadImpView = [], [], []

for i in col:
	try:
		if i.IsLinked != True:
			cadImp.append(i)
			cadImpType.append(i.Document.GetElement(i.GetTypeId()))
			cadImpView.append(doc.GetElement(i.OwnerViewId))
	except:
		pass

# Preparing output to Dynamo
OUT = [cadImp, cadImpType, cadImpView]
# ----------------------------------------
code_block = CodeBlock(out=python_script) { out[0]; out[1]; out[2]; }
instance = Output(code_block.out0)
type = Output(code_block.out1)
ownerView = Output(code_block.out2)
