# Dynamo custom node CeilingsCreate.dyf "© Ceilings.Create" (Dynamo 2.12.1.8246)
# category: Crumple.Revit.Create
# A new method unique to Revit 2022 that enables ceilings via the sketch API to support internal loops. Will not work in previous versions, and works best when the curves are in the form of list of lists of curves in continuous order.

curvelists = Input(curvelists: var[]..[])  # List of list of curves. The curves must be in a continuous/closed order.
ceilingtypes = Input(ceilingtypes: var[]..[])  # List of types to be applied each set of curves as a ceilings. Note that if you provide a shorter list of types than the curve lists it will behave as longest lacing.
levels = Input(levels: var[]..[])  # Levels for the elements to be created at.
variable_size_lists = Python(IN[0]=curvelists, IN[1]=ceilingtypes, IN[2]=levels)  # CPython3
# ---------- variable_size_lists.python (73 lines) ----------
# Made by Gavin Crump
# Free for use
# BIM Guru, www.bimguru.com.au

# Boilerplate text
import clr

clr.AddReference("RevitNodes")
import Revit
clr.ImportExtensions(Revit.Elements)
clr.ImportExtensions(Revit.GeometryConversion)

clr.AddReference("RevitServices")
import RevitServices
from RevitServices.Persistence import DocumentManager
from RevitServices.Transactions import TransactionManager

clr.AddReference("RevitAPI")
import Autodesk
from Autodesk.Revit.DB import CurveLoop, Ceiling

# Current doc/app/ui
doc = DocumentManager.Instance.CurrentDBDocument
uiapp = DocumentManager.Instance.CurrentUIApplication 
app = uiapp.Application
# Get revit version
revit_version = int(app.VersionNumber)

# Define list/unwrap list functions
def uwlist(input):
	result = input if isinstance(input, list) else [input]
	return UnwrapElement(result)

def listpad(lst,count):
	padded = []
	length = len(lst)
	for i in range(0,count):
		if i < length:
			padded.append(lst[i])
		else:
			padded.append(lst[-1])
	return padded

# If we are in Revit 2022 or higher, print
if revit_version > 2021:
    # Preparing input from dynamo to revit
    roomset = IN[0]
    maxlst = len(roomset)
    
    types  = listpad(uwlist(IN[1]),maxlst)
    levels = listpad(uwlist(IN[2]),maxlst)
    
    ceilings = []
    
    TransactionManager.Instance.EnsureInTransaction(doc)
    
    for rm,f,l in zip(roomset,types,levels):
    	curveloops = []
    	for crv_setd in rm:
    		crv_setr = []
    		for crv_d in crv_setd:
    			crv_setr.append(crv_d.ToRevitType())
    		curveloop = CurveLoop.Create(crv_setr)
    		curveloops.append(curveloop)
    	clg = Ceiling.Create(doc, curveloops, f.Id, l.Id)
    	ceilings.append(clg)
    
    TransactionManager.Instance.TransactionTaskDone()
    # Preparing output to Dynamo
    OUT = ceilings, "SUCCESS: Version is 2022 or higher."
# Otherwise tell the user we can't proceed
else:
	OUT = [], "ERROR: Only works in Revit 2022 or higher."
# ----------------------------------------
code_block = CodeBlock(x=variable_size_lists) { x[0]; x[1]; }
code_block_2 = CodeBlock { "Height Offset From Level"; }
offset = Input(offset: var[]..[] = [2700])  # Height offset.
setParameterByName = Element.SetParameterByName(element=code_block.out0, parameterName=code_block_2, value=offset, lacing=Longest)
ceilings = Output(setParameterByName)
versionCheck = Output(code_block.out1)
