# Dynamo custom node CipherFrom.dyf (Dynamo 2.3.0.5885)
# category: Crumple.String.Generate
# Converts numbers (or numbers as strings) from 'CipherTo' or from an alternative means back to lower case strings, including spaces.

data = Input(data: var[]..[])
toNumber = String.ToNumber(str=data)
code_block = CodeBlock(data=toNumber) { low = "a".."z"..1; lower = DSCore.List.Insert(low, " ", 0); DSCore.List.GetItemAtIndex(lower, data); }
strings = Output(code_block.out2)
