# Dynamo custom node CollectBipgs.dyf "© Collect.BIPGs" (Dynamo 2.12.1.8246)
# category: Crumple.Revit.Query
# Returns all BuiltIn Parameter Groups by group and type.

refresh = Input(refresh: bool = true)  # Toggle to refresh
python_script = Python(IN[0]=refresh)  # IronPython2
# ---------- python_script.python (17 lines) ----------
# Made by Gavin Crump
# Free for use
# BIM Guru, www.bimguru.com.au

# Boilerplate text
import clr
import System

clr.AddReference("RevitAPI")
import Autodesk 
from Autodesk.Revit.DB import BuiltInParameterGroup

# Enumerate over all BIPG types
pgnms = [(a, a.ToString()) for a in System.Enum.GetValues(BuiltInParameterGroup)]

# Preparing output to Dynamo
OUT = zip(*pgnms)
# ----------------------------------------
code_block = CodeBlock(lst=python_script) { pg = lst[0]; nm = lst[1]; }
groups = Output(code_block.pg)  # The parameter groups.
names = Output(code_block.nm)  # The parameter group names.
