# Dynamo custom node CollectDesignOptions.dyf "© Collect.DesignOptions" (Dynamo 2.12.1.8246)
# category: Crumple.Revit.Query
# Returns all design options in a document.
# packages: Crumple 2022.2.13

docOrLink = Input(docOrLink: var[]..[] = null)  # Uses current if none provided. Accepts document or link instance.
revit_getdocument = Custom[© Revit.GetDocument](docOrLink=docOrLink)  # package Crumple; If no input is specified or an invalid one is, returns current document. If a link instance is provided, it returns the linked document. If a document is provided it will pass it through.
python_script = Python(IN[0]=revit_getdocument.document)  # IronPython2
# ---------- python_script.python (17 lines) ----------
# Made by Gavin Crump
# Free for use
# BIM Guru, www.bimguru.com.au

# Boilerplate text
import clr

clr.AddReference("RevitAPI")
import Autodesk 
from Autodesk.Revit.DB import FilteredElementCollector, DesignOption


# Current doc/app/ui
doc = IN[0]

# Preparing output to Dynamo
OUT = FilteredElementCollector(doc).OfClass(DesignOption).ToElements()
# ----------------------------------------
designOptions = Output(python_script)
