# Dynamo custom node CollectFillPatterns.dyf "© Collect.FillPatterns" (Dynamo 2.3.1.11775)
# category: Crumple.Revit.Query
# Returns all fill patterns in a document.
# packages: Crumple 2022.2.13

docOrLink = Input(docOrLink: var[]..[] = null)  # Uses current if none provided. Accepts document or link instance.
revit_getdocument = Custom[© Revit.GetDocument](docOrLink=docOrLink)  # package Crumple; If no input is specified or an invalid one is, returns current document. If a link instance is provided, it returns the linked document. If a document is provided it will pass it through.
python_script = Python(IN[0]=revit_getdocument.document)
# ---------- python_script.python (34 lines) ----------
# Made by Gavin Crump
# Free for use
# BIM Guru, www.bimguru.com.au

# Boilerplate text
import clr

clr.AddReference('RevitAPI')
from Autodesk.Revit.DB import *
import Autodesk

clr.AddReference("RevitServices")
import RevitServices
from RevitServices.Persistence import DocumentManager

# Current document
doc = IN[0]

isDrafting = []

collector = FilteredElementCollector(doc)
allFillPatterns = collector.OfClass(FillPatternElement).ToElements()

fillPatterns = UnwrapElement(allFillPatterns)
Names = [p.Name for p in fillPatterns]

for p in fillPatterns:
	fpt = p.GetFillPattern()
	if fpt.Target == FillPatternTarget.Drafting :
		isDrafting.append(True)
	else:
		isDrafting.append(False)

OUT = [allFillPatterns, Names, isDrafting]
# ----------------------------------------
code_block = CodeBlock(out=python_script) { ele = out[0]; nam = out[1]; drf = out[2]; }
names = Output(code_block.nam)  # The names of the patterns
elements = Output(code_block.ele)  # The patterns as elements
drafting = Output(code_block.drf)  # Are the patterns drafting?
