# Dynamo custom node CollectImages.dyf "© Collect.Images" (Dynamo 2.12.1.8246)
# category: Crumple.Revit.Query
# Returns all image instances in a document as well as their names, types and owner views.
# packages: Crumple 2022.2.13

docOrLink = Input(docOrLink: var[]..[] = null)  # Uses current if none provided. Accepts document or link instance.
revit_getdocument = Custom[© Revit.GetDocument](docOrLink=docOrLink)  # package Crumple; If no input is specified or an invalid one is, returns current document. If a link instance is provided, it returns the linked document. If a document is provided it will pass it through.
python_script = Python(IN[0]=revit_getdocument.document)  # CPython3
# ---------- python_script.python (27 lines) ----------
# Made by Gavin Crump
# Free for use
# BIM Guru, www.bimguru.com.au

# Boilerplate text
import clr

clr.AddReference("RevitAPI")
import Autodesk
from Autodesk.Revit.DB import FilteredElementCollector, BuiltInCategory, Element

doc = IN[0]

# Collect all images
images = FilteredElementCollector(doc).OfCategory(BuiltInCategory.OST_RasterImages).WhereElementIsNotElementType().ToElements()

# Get instance properties
imageView = []

for i in images:
    try:
        imageView.append(doc.GetElement(i.OwnerViewId))
    except:
        imageView.append(None)

# Preparing output to Dynamo
OUT = images, imageView
# ----------------------------------------
code_block = CodeBlock(out=python_script) { out[0]; out[1]; }
instances = Output(code_block.out0)
name = Element.Name(element=code_block.out1)
fileNames = Output(name)
ownerViews = Output(code_block.out1)
