# Dynamo custom node CollectLegendTypes.dyf "© Collect.LegendTypes" (Dynamo 2.3.1.11775)
# category: Crumple.Revit.Query
# Returns all legend types in a document.
# packages: Crumple 2022.2.13

docOrLink = Input(docOrLink: var[]..[] = null)  # Uses current if none provided. Accepts document or link instance.
revit_getdocument = Custom[© Revit.GetDocument](docOrLink=docOrLink)  # package Crumple; If no input is specified or an invalid one is, returns current document. If a link instance is provided, it returns the linked document. If a document is provided it will pass it through.
python_script = Python(IN[0]=revit_getdocument.document)
# ---------- python_script.python (28 lines) ----------
# Made by Gavin Crump
# Free for use
# BIM Guru, www.bimguru.com.au

# Boilerplate text
import clr

# Import RevitAPI
clr.AddReference("RevitAPI")
import Autodesk
from Autodesk.Revit.DB import *

# Get the project document.
doc = IN[0]

# Get all views
Views_doc = FilteredElementCollector(doc).OfClass(View).ToElements()

# Create empty lists
Legend_list = []

# Find views that aren't legends, then non-template
for view in Views_doc:
	if view.ViewType == ViewType.Legend:
		Legend_list.append(view)

# Output cleaned view lists
OUT = Legend_list
# ----------------------------------------
legendTypes = Output(python_script)  # All legends in the current document.
