# Dynamo custom node CollectLinePatterns.dyf "© Collect.LinePatterns" (Dynamo 2.3.1.11775)
# category: Crumple.Revit.Query
# Returns all line patterns in a document.
# packages: Crumple 2022.2.13

docOrLink = Input(docOrLink: var[]..[] = null)  # Uses current if none provided. Accepts document or link instance.
revit_getdocument = Custom[© Revit.GetDocument](docOrLink=docOrLink)  # package Crumple; If no input is specified or an invalid one is, returns current document. If a link instance is provided, it returns the linked document. If a document is provided it will pass it through.
python_script = Python(IN[0]=revit_getdocument.document)
# ---------- python_script.python (20 lines) ----------
# Made by Gavin Crump
# Free for use
# BIM Guru, www.bimguru.com.au

# Boilerplate text
import clr

clr.AddReference('RevitAPI')
from Autodesk.Revit.DB import *
import Autodesk

# Current document
doc = IN[0]

collector = FilteredElementCollector(doc)
allLinePatterns = collector.OfClass(LinePatternElement).ToElements()

Names = [UnwrapElement(p).Name for p in allLinePatterns]

OUT = [allLinePatterns, Names]
# ----------------------------------------
code_block = CodeBlock(out=python_script) { ele = out[0]; nam = out[1]; }
elements = Output(code_block.ele)  # The patterns as elements
names = Output(code_block.nam)  # The names of the patterns
