# Dynamo custom node CollectLines.dyf "© Collect.Lines" (Dynamo 2.3.1.11775)
# category: Crumple.Revit.Query
# Returns all lines in a document, with the option to exclude or include detail/model lines in the output. By default will return all of them.
# packages: Crumple 2022.2.13

includeDetail = Input(includeDetail: bool = true)
includeModel = Input(includeModel: bool = true)
docOrLink = Input(docOrLink: var[]..[] = null)  # Uses current if none provided. Accepts document or link instance.
revit_getdocument = Custom[© Revit.GetDocument](docOrLink=docOrLink)  # package Crumple; If no input is specified or an invalid one is, returns current document. If a link instance is provided, it returns the linked document. If a document is provided it will pass it through.
python_script = Python(IN[0]=includeDetail, IN[1]=includeModel, IN[2]=revit_getdocument.document)
# ---------- python_script.python (35 lines) ----------
# Made by Gavin Crump
# Free for use
# BIM Guru, www.bimguru.com.au

# Boilerplate text
import clr

clr.AddReference("RevitNodes")
import Revit
clr.ImportExtensions(Revit.Elements)

clr.AddReference("RevitAPI")
import Autodesk 
from Autodesk.Revit.DB import *

# Current doc/app/ui
doc = IN[2]

# Collect all lines in project and build output lists
collector = FilteredElementCollector(doc).OfCategory(BuiltInCategory.OST_Lines)

detail, model, type, curveout = IN[0], IN[1], [], []

for i in collector:
	if i.Name == "Detail Lines":
		if detail:
			curveout.append(i.ToDSType(True))
			type.append(True)
	else:
		if model:
			curveout.append(i.ToDSType(True))
			type.append(False)

# Preparing output to Dynamo
OUT = [curveout, type]
# ----------------------------------------
code_block = CodeBlock(out=python_script) { curves = out[0]; isDetail = out[1]; }
lines = Output(code_block.curves)
isDetail = Output(code_block.isDetail)
