# Dynamo custom node CollectPrintSettings.dyf "© Collect.PrintSettings" (Dynamo 2.16.2.5624)
# category: Crumple.Revit.Query
# Returns all print settings in the provided document and their names.
# packages: Crumple 2026.7.1

docOrLink = Input(docOrLink: var[]..[] = null)  # Uses current if none provided. Accepts document or link instance.
revit_getdocument = Custom[© Revit.GetDocument](docOrLink=docOrLink)  # package Crumple; If no input is specified or an invalid one is, returns current document. If a link instance is provided, it returns the linked document. If a document is provided it will pass it through.
python_script = Python(IN[0]=revit_getdocument.document)  # CPython3
# ---------- python_script.python (19 lines) ----------
# Made by Gavin Crump
# Free for use
# BIM Guru, www.bimguru.com.au

# Boilerplate text
import clr

clr.AddReference("RevitAPI")
import Autodesk 
from Autodesk.Revit.DB import PrintSetting, FilteredElementCollector

doc = IN[0]

# Settings
settings = FilteredElementCollector(doc).OfClass(PrintSetting).ToElements()
names    = [s.Name for s in settings]

#Outputs
OUT = settings, names
# ----------------------------------------
code_block = CodeBlock(lst=python_script) { settings = lst[0]; names    = lst[1]; }
printSettings = Output(code_block.settings)
settingNames = Output(code_block.names)
