# Dynamo custom node CollectRevitLinks.dyf "© Collect.RevitLinks" (Dynamo 2.12.1.8246)
# category: Crumple.Revit.Query
# Returns all Revit link types in the current document, as well as all instance elements of those types.
# packages: Crumple 2022.2.13

docOrLink = Input(docOrLink: var[]..[] = null)  # Uses current if none provided. Accepts document or link instance.
revit_getdocument = Custom[© Revit.GetDocument](docOrLink=docOrLink)  # package Crumple; If no input is specified or an invalid one is, returns current document. If a link instance is provided, it returns the linked document. If a document is provided it will pass it through.
python_script = Python(IN[0]=revit_getdocument.document)  # IronPython2; graph output
# ---------- python_script.python (21 lines) ----------
# Made by Gavin Crump
# Free for use
# BIM Guru, www.bimguru.com.au

# Boilerplate text
import clr

clr.AddReference("RevitAPI")
import Autodesk
from Autodesk.Revit.DB import FilteredElementCollector, BuiltInCategory

doc = IN[0]

linkInstances = FilteredElementCollector(doc).OfCategory(BuiltInCategory.OST_RvtLinks).WhereElementIsNotElementType().ToElements()

types = []

for i in linkInstances:
	types.append(doc.GetElement(i.GetTypeId()))

OUT = linkInstances, types
# ----------------------------------------
code_block = CodeBlock(data=python_script) { inst = data[0]; type = data[1]; }
groupByKey = List.GroupByKey(list=code_block.inst, keys=code_block.type)
linkTypes = Output(groupByKey.uniqueKeys)
linkInstances = Output(groupByKey.groups)
