# Dynamo custom node CollectSpaceSchedules.dyf "© Collect.SpaceSchedules" (Dynamo 2.3.1.11775)
# category: Crumple.Revit.Query
# Gets all occupancy, power and lighting schedules currently applied to any Space Types in a document. Also returns their name and Id.
# packages: Crumple 2022.2.13

docOrLink = Input(docOrLink: var[]..[] = null)  # Uses current if none provided. Accepts document or link instance.
revit_getdocument = Custom[© Revit.GetDocument](docOrLink=docOrLink)  # package Crumple; If no input is specified or an invalid one is, returns current document. If a link instance is provided, it returns the linked document. If a document is provided it will pass it through.
python_script = Python(IN[0]=revit_getdocument.document)
# ---------- python_script.python (24 lines) ----------
# Made by Gavin Crump
# Free for use
# BIM Guru, www.bimguru.com.au

# Boilerplate text
import clr

clr.AddReference("RevitNodes")
import Revit
clr.ImportExtensions(Revit.Elements)
clr.ImportExtensions(Revit.GeometryConversion)

clr.AddReference("RevitAPI")
from Autodesk.Revit.DB import *
from Autodesk.Revit.DB.Analysis import *

# Current doc/app/ui
doc = IN[0]

# Collect all Space types
spaces = FilteredElementCollector(doc).OfClass(HVACLoadSpaceType).ToElements()
	
# Outputs
OUT = spaces
# ----------------------------------------
code_block = CodeBlock()
# ---------- code_block.designscript (3 lines) ----------
["Occupancy Schedule",
"Lighting Schedule",
"Power Schedule"];
# ----------------------------------------
getParameterValueByName = Element.GetParameterValueByName(element=python_script, parameterName=code_block@L1)
type = Object.Type(obj=getParameterValueByName)
code_block_2 = CodeBlock { "string"; true; }
contains = String.Contains(str=type, searchFor=code_block_2.out0, ignoreCase=code_block_2.out1)
filterByBoolMask = List.FilterByBoolMask(list=getParameterValueByName, mask=contains)
uniqueItems = List.UniqueItems(list=filterByBoolMask.out@L2)
code_block_3 = CodeBlock(lst=uniqueItems) { os = lst[0]; ls = lst[1]; ps = lst[2]; }
occupancy = Output(code_block_3.os)  # Schedule as an element.
lighting = Output(code_block_3.ls)  # Schedule as an element.
power = Output(code_block_3.ps)  # Schedule as an element.
