# Dynamo custom node CollectSpaceTypes.dyf "© Collect.SpaceTypes" (Dynamo 2.12.1.8246)
# category: Crumple.Revit.Query
# Collects all space types as well as their names from a document.
# packages: Crumple 2022.2.13

docOrLink = Input(docOrLink: var[]..[] = null)  # Uses current if none provided. Accepts document or link instance.
revit_getdocument = Custom[© Revit.GetDocument](docOrLink=docOrLink)  # package Crumple; If no input is specified or an invalid one is, returns current document. If a link instance is provided, it returns the linked document. If a document is provided it will pass it through.
python_script = Python(IN[0]=revit_getdocument.document)  # IronPython2
# ---------- python_script.python (19 lines) ----------
# Made by Gavin Crump
# Free for use
# BIM Guru, www.bimguru.com.au

# Boilerplate text
import clr

clr.AddReference("RevitAPI")
from Autodesk.Revit.DB import FilteredElementCollector
from Autodesk.Revit.DB.Analysis import HVACLoadSpaceType

# Current doc/app/ui
doc = IN[0]

# Collect all Space types
spaces = FilteredElementCollector(doc).OfClass(HVACLoadSpaceType).ToElements()
	
# Outputs
OUT = spaces, [s.Name for s in spaces]
# ----------------------------------------
code_block = CodeBlock(lst=python_script) { styp = lst[0]; nams = lst[1]; }
spaceTypes = Output(code_block.styp)  # Space types as elements.
typeNames = Output(code_block.nams)  # Type names as strings.
