# Dynamo custom node CollectViewFamilyTypes.dyf "© Collect.ViewTypes" (Dynamo 2.12.1.8246)
# category: Crumple.Revit.Query
# Returns all view family type objects and names.

Refresh = Input(Refresh: bool = true)  # Toggle to refresh
python_script = Python(IN[0]=Refresh)  # CPython3
# ---------- python_script.python (21 lines) ----------
# Made by Gavin Crump
# Free for use
# BIM Guru, www.bimguru.com.au

# Boilerplate text
import clr
import System

clr.AddReference("RevitAPI")
import Autodesk 
from Autodesk.Revit.DB import ViewFamily

# Get enum name
def enumGetName(enum, enumClass):
    return System.Enum.GetName(enumClass,enum)

# Enumerate over all BIPG types
vfs = System.Enum.GetValues(ViewFamily)

# Preparing output to Dynamo
OUT = vfs, [enumGetName(e, ViewFamily) for e in vfs]
# ----------------------------------------
code_block = CodeBlock(lst=python_script) { pg = lst[0]; nm = lst[1]; }
viewFamilyTypes = Output(code_block.pg)  # The types.
names = Output(code_block.nm)  # The names.
