# Dynamo custom node CollectViewportTypes.dyf "© Collect.ViewportTypes" (Dynamo 2.12.1.8246)
# category: Crumple.Revit.Query
# Returns all viewport types and their names in the provided document.
# packages: Crumple 2022.5.27

docOrLink = Input(docOrLink: var[]..[] = null)  # Uses current if none provided. Accepts document or link instance.
revit_getdocument = Custom[© Revit.GetDocument](docOrLink=docOrLink)  # package Crumple; If no input is specified or an invalid one is, returns current document. If a link instance is provided, it returns the linked document. If a document is provided it will pass it through.
python_script = Python(IN[0]=revit_getdocument.document)  # IronPython2
# ---------- python_script.python (25 lines) ----------
# Made by Gavin Crump
# Free for use
# BIM Guru, www.bimguru.com.au

# Boilerplate text
import clr

clr.AddReference("RevitAPI")
import Autodesk 
from Autodesk.Revit.DB import BuiltInParameter, ParameterFilterRuleFactory,\
ElementId, ElementParameterFilter, FilteredElementCollector, Element

# Current doc/app/ui
doc = IN[0]

# Get all viewport types
BIP_FAMILYNAME = BuiltInParameter.SYMBOL_FAMILY_NAME_PARAM

col_rule  = ParameterFilterRuleFactory.CreateEqualsRule(ElementId(BIP_FAMILYNAME), "Viewport", False)
col_filt  = ElementParameterFilter(col_rule)

viewportTypes_all = FilteredElementCollector(doc).WhereElementIsElementType().WherePasses(col_filt).ToElements()

# Preparing output to Dynamo
OUT = viewportTypes_all, [Element.Name.__get__(v) for v in viewportTypes_all]
# ----------------------------------------
code_block = CodeBlock(x=python_script) { x[0]; x[1]; }
viewportTypes = Output(code_block.out0)
names = Output(code_block.out1)
