# Dynamo custom node CollectViewports.dyf "© Collect.Viewports" (Dynamo 2.16.2.5624)
# category: Crumple.Revit.Query
# Returns all viewports in the current document.
# packages: Crumple 2026.7.1

docOrLink = Input(docOrLink: var[]..[] = null)  # Uses current if none provided. Accepts document or link instance.
revit_getdocument = Custom[© Revit.GetDocument](docOrLink=docOrLink)  # package Crumple; If no input is specified or an invalid one is, returns current document. If a link instance is provided, it returns the linked document. If a document is provided it will pass it through.
python_script = Python(IN[0]=revit_getdocument.document)  # CPython3
# ---------- python_script.python (18 lines) ----------
# Made by Gavin Crump
# Free for use
# BIM Guru, www.bimguru.com.au

# Boilerplate text
import clr

clr.AddReference("RevitAPI")
import Autodesk 
from Autodesk.Revit.DB import FilteredElementCollector, Viewport

# Current doc/app/ui
doc = IN[0]

viewports_all = FilteredElementCollector(doc).OfClass(Viewport).ToElements()

# Preparing output to Dynamo
OUT = viewports_all
# ----------------------------------------
viewports = Output(python_script)
