# Dynamo custom node CollectWarnings.dyf "© Collect.Warnings" (Dynamo 2.12.1.8246)
# category: Crumple.Revit.Query
# Returns all warnings in the Revit model in their Revit db format.
# packages: Crumple 2022.2.13

docOrLink = Input(docOrLink: var[]..[] = null)  # Uses current if none provided. Accepts document or link instance.
revit_getdocument = Custom[© Revit.GetDocument](docOrLink=docOrLink)  # package Crumple; If no input is specified or an invalid one is, returns current document. If a link instance is provided, it returns the linked document. If a document is provided it will pass it through.
python_script = Python(IN[0]=revit_getdocument.document)  # IronPython2
# ---------- python_script.python (12 lines) ----------
# Made by Gavin Crump
# Free for use
# BIM Guru, www.bimguru.com.au

# Boilerplate text
import clr

# Current doc/app/ui
doc = IN[0]

# Preparing output to Dynamo
OUT = doc.GetWarnings()
# ----------------------------------------
warnings = Output(python_script)
