# Dynamo custom node ColourOverrideAlpha.dyf "© Colour.OverrideAlpha" (Dynamo 2.3.0.5885)
# category: Crumple.Data.Actions
# Overrides the alpha value (transparency) of all colours fed into the node. The transparency value should be between 0 and 255.

colour = Input(colour: DSCore.Color)  # Colours to override
alpha = Input(alpha: int = 255)  # Alpha override value. Should be between 0 and 255. 255 = Fully Opaque 0 = Fully transparent
code_block = CodeBlock(a=alpha) { a>255 || a<0; 255; a; }
if_ = If(test=code_block.out0, true=code_block.out1, false=code_block.a)
code_block_2 = CodeBlock(colour=colour, t=if_) { r = Color.Red(colour); g = Color.Blue(colour); b = Color.Green(colour); DSCore.Color.ByARGB(t,r,g,b); }
colour_2 = Output(code_block_2.out3)  # "colour"; Overriden colours
