# Dynamo custom node CoordinatesGetLinkTransform.dyf "© Coordinates.GetLinkTransform" (Dynamo 2.3.1.11775)
# category: Crumple.Revit.Query
# Given a Revit link instance, returns the coordinate system for transformation of location.

linkInstance = Input(linkInstance: var[]..[])
python_script = Python(IN[0]=linkInstance)
# ---------- python_script.python (20 lines) ----------
# Made by Gavin Crump
# Free for use
# BIM Guru, www.bimguru.com.au

# Boilerplate text
import clr

clr.AddReference("RevitAPI")
from Autodesk.Revit.DB import RevitLinkInstance

clr.AddReference("RevitNodes")
import Revit
clr.ImportExtensions(Revit.GeometryConversion)

# Get link transform
link_instance = UnwrapElement(IN[0])
link_transform = link_instance.GetTotalTransform().ToCoordinateSystem(True)

# Preparing output to Dynamo
OUT = link_transform
# ----------------------------------------
coordinateSystem = Output(python_script)
