# Dynamo custom node CoordinatesSp.dyf "© Coordinates.SP" (Dynamo 2.3.1.11775)
# category: Crumple.Revit.Query
# This node will return the Revit survey point as well as the NS, EW and elevation values.
# packages: Crumple 2022.2.13

unitFactor = Input(unitFactor: double = 304.8)  # Because imperial units are silly
docOrLink = Input(docOrLink: var[]..[] = null)  # Uses current if none provided. Accepts document or link instance.
revit_getdocument = Custom[© Revit.GetDocument](docOrLink=docOrLink)  # package Crumple; If no input is specified or an invalid one is, returns current document. If a link instance is provided, it returns the linked document. If a document is provided it will pass it through.
python_script = Python(IN[0]=unitFactor, IN[1]=revit_getdocument.document)
# ---------- python_script.python (38 lines) ----------
# Made by Gavin Crump
# Free for use
# BIM Guru, www.bimguru.com.au
# Credit to Genius Loci for much of the workflow

# Boilerplate text
import clr
import math

# Revit nodes
clr.AddReference("RevitNodes")
import Revit
clr.ImportExtensions(Revit.Elements)
clr.ImportExtensions(Revit.GeometryConversion)

# Revit services and API
clr.AddReference("RevitServices")
import RevitServices
from RevitServices.Persistence import DocumentManager 

clr.AddReference("RevitAPI")
import Autodesk 
from Autodesk.Revit.DB import *

# Current doc/app/ui
doc = IN[1]

# Get project base point
bps     = FilteredElementCollector(doc).OfClass(BasePoint).ToElements()
svp     = bps[0]

# Get pbp values
svp_ew = svp.get_Parameter(BuiltInParameter.BASEPOINT_EASTWEST_PARAM).AsDouble() * IN[0]
svp_ns = svp.get_Parameter(BuiltInParameter.BASEPOINT_NORTHSOUTH_PARAM).AsDouble() * IN[0]
svp_el = svp.get_Parameter(BuiltInParameter.BASEPOINT_ELEVATION_PARAM).AsDouble() * IN[0]

# Preparing output to Dynamo
OUT = [svp_ns, svp_ew, svp_el]
# ----------------------------------------
code_block = CodeBlock(x=python_script) { x[0]; x[1]; x[2]; }
NS = Output(code_block.out0)  # The Northing value of the survey point returned in Revit coordinates.
EW = Output(code_block.out1)  # The Easting value of the survey point returned in Revit coordinates.
Elevation = Output(code_block.out2)  # The Elevation value of the survey point returned in Revit coordinates.
