# Dynamo custom node CoordinatesTranslatePoints.dyf "© Coordinates.TranslatePoints" (Dynamo 2.3.1.11775)
# category: Crumple.Revit.Actions
# This node translates points in Dynamo coordinates to their respective Revit project coordinate.

code_block = CodeBlock { xy = Plane.XY(); Plane.ToCoordinateSystem(xy); Autodesk.Point.Origin(); Vector.ZAxis(); }
unitFactor = Input(unitFactor: double = 304.8)  # Because imperial units are silly
python_script = Python(IN[0]=unitFactor)
# ---------- python_script.python (45 lines) ----------
# Made by Gavin Crump
# Free for use
# BIM Guru, www.bimguru.com.au
# Credit to Genius Loci for much of the workflow

# Boilerplate text
import clr
import math

# Revit nodes
clr.AddReference("RevitNodes")
import Revit
clr.ImportExtensions(Revit.Elements)
clr.ImportExtensions(Revit.GeometryConversion)

# Revit services and API
clr.AddReference("RevitServices")
import RevitServices
from RevitServices.Persistence import DocumentManager 

clr.AddReference("RevitAPI")
import Autodesk 
from Autodesk.Revit.DB import *

# Current doc/app/ui
doc = DocumentManager.Instance.CurrentDBDocument

# Get project position
ori = doc.ActiveProjectLocation.GetProjectPosition(XYZ(0,0,0))

# Get project base point
bps = FilteredElementCollector(doc).OfClass(BasePoint).ToElements()
pbp = bps[1]

# Get pbp angle
an = pbp.get_Parameter(BuiltInParameter.BASEPOINT_ANGLETON_PARAM).AsDouble()
pbp_an = round(an * 180/math.pi)

# Get translation values from origin
y = ori.NorthSouth * IN[0]
x = ori.EastWest * IN[0]
z = ori.Elevation  * IN[0]

# Preparing output to Dynamo
OUT = [pbp_an, x, y, z]
# ----------------------------------------
code_block_2 = CodeBlock(out=python_script) { a = out[0]; x = out[1]*-1; y = out[2]*-1; z = out[3]*-1; }
rotate = CoordinateSystem.Rotate(coordinateSystem=code_block.out1, origin=code_block.out2, axis=code_block.out3, degrees=code_block_2.a)
origin = Point.Origin()
byCartesianCoordinates = Point.ByCartesianCoordinates(cs=rotate, x=code_block_2.x, y=code_block_2.y, z=code_block_2.z)
byTwoPoints = Vector.ByTwoPoints(start=origin, end=byCartesianCoordinates)
distanceTo = Geometry.DistanceTo(geometry=origin, other=byCartesianCoordinates)
translate = CoordinateSystem.Translate(coordinateSystem=rotate, direction=byTwoPoints, distance=distanceTo)
points_dyn = Input(points_dyn: var[]..[])  # Points in Dynamo for relocation to suit internal Revit coordinates.
code_block_3 = CodeBlock(in_pts=points_dyn) { in_pts.X; in_pts.Y; in_pts.Z; }
byCartesianCoordinates_2 = Point.ByCartesianCoordinates(cs=translate, x=code_block_3.out0, y=code_block_3.out1, z=code_block_3.out2)
points_rvt = Output(byCartesianCoordinates_2)  # Points in Revit correctly aligned to the coordinates system.
