# Dynamo custom node CurrentPath.dyf "© CurrentPath" (Dynamo 2.3.1.11775)
# category: Crumple.Application.Revit
# Returns the full file path, directory path and namer of the current Revit document.

refresh = Input(refresh: bool = true)
python_script = Python(IN[0]=refresh)
# ---------- python_script.python (21 lines) ----------
# Made by Gavin Crump
# Free for use
# BIM Guru, www.bimguru.com.au

# Boilerplate text
import clr

clr.AddReference("RevitServices")
import RevitServices
from RevitServices.Persistence import DocumentManager 

clr.AddReference("RevitAPI")
import Autodesk
from Autodesk.Revit.DB import Document

# Current doc and path
doc = DocumentManager.Instance.CurrentDBDocument
path = Document.PathName.GetValue(doc)

# Name and path
OUT = path,path.rsplit("\\",1)
# ----------------------------------------
code_block = CodeBlock(out=python_script) { out[0]; out[1][0]; out[1][1]; }
filePath = Output(code_block.out0)
directoryPath = Output(code_block.out1)
fileName = Output(code_block.out2)
