# Dynamo custom node DesignOptions.dyf "© DesignOptions" (Dynamo 2.3.0.5885)
# category: Crumple.Revit.DesignOptions
# Returns all design options in the model.

Referesh = Input(Referesh: bool = true)
python_script = Python(IN[0]=Referesh)
# ---------- python_script.python (25 lines) ----------
# Made by Gavin Crump
# Free for use
# BIM Guru, www.bimguru.com.au

# Boilerplate text
import clr

clr.AddReference("RevitServices")
import RevitServices
from RevitServices.Persistence import DocumentManager

clr.AddReference("RevitNodes")
import Revit
clr.ImportExtensions(Revit.Elements)

clr.AddReference("RevitAPI")
import Autodesk 
from Autodesk.Revit.DB import *


# Current doc/app/ui
doc = DocumentManager.Instance.CurrentDBDocument

# Preparing output to Dynamo
OUT = FilteredElementCollector(doc).OfClass(DesignOption).ToElements()
# ----------------------------------------
designOptions = Output(python_script)
