# Dynamo custom node DesignOptionsBySet.dyf "© DesignOptionsBySet" (Dynamo 2.3.0.5885)
# category: Crumple.Revit.DesignOptions
# Returns all design options broken down by primary and secondary, as well as their related option set.

Refresh = Input(Refresh: bool = true)
designOptions = Custom[DesignOptions](Referesh=Refresh)  # Returns all design options in the model.
designOptionSet = Custom[DesignOptionSet](designOption=designOptions)  # For a given design option, return its related set.
groupByKey = List.GroupByKey(list=designOptions, keys=designOptionSet)
code_block = CodeBlock(t1=groupByKey.groups) { DSCore.List.FirstItem(t1@L2<1>); DSCore.List.RestOfItems(t1@L2<1>); }
primaryOptions = Output(code_block.out0)
secondaryOptions = Output(code_block.out1)
optionSets = Output(groupByKey.unique_keys)
