# Dynamo custom node DynamoCurrentScript.dyf "© Dynamo.CurrentScript" (Dynamo 2.12.1.8246)
# category: Crumple.Application.Query
# Returns the name of the currently active Dynamo script, with an optional extension.

extension = Input(extension: bool = false)
python_script = Python(IN[0]=extension)  # CPython3
# ---------- python_script.python (22 lines) ----------
# Made by Gavin Crump
# Free for use
# BIM Guru, www.bimguru.com.au

# Boilerplate text
import clr

clr.AddReference('DynamoRevitDS')
import Dynamo

# Check Dynamo workspace properties
dynamoRevit = Dynamo.Applications.DynamoRevit()
currentWorkspace = dynamoRevit.RevitDynamoModel.CurrentWorkspace
script = currentWorkspace.Name

if IN[0]:
	ext = ".dyn"
else:
	ext = ""

# Preparing output to Dynamo
OUT = script + ext
# ----------------------------------------
scriptName = Output(python_script)
