# Dynamo custom node ElementTypeByName.dyf "© ElementTypeByName" (Dynamo 2.3.0.5885)
# category: Crumple.Revit.ElementType
# Given an element type name, if it finds a match it will return that element type.
# packages: Crumple 2021.4.24

elementtypes = Custom[© ElementTypes]()  # package Crumple; Returns all element types and their names in the active document.
name = Input(name: var[]..[])
indexOf = List.IndexOf(list=elementtypes.typeNames, element=name)
getItemAtIndex = List.GetItemAtIndex(list=elementtypes.elementTypes, index=indexOf)
elementType = Output(getItemAtIndex)
