# Dynamo custom node ElementWorksets.dyf "© Element.Workset" (Dynamo 2.16.2.5624)
# category: Crumple.Revit.Query
# Given a list of elements, return their associated workset, its name and a unique list of workset names belonging to that list of elements.

element = Input(element: var[]..[])  # Elements to inspect.
python_script = Python(IN[0]=element)  # CPython3
# ---------- python_script.python (36 lines) ----------
# Made by Gavin Crump
# Free for use
# BIM Guru, www.bimguru.com.au

# Boilerplate text
import clr

# Define list/unwrap list functions
def uwlist(input):
    result = input if isinstance(input, list) else [input]
    return UnwrapElement(result)

def objOrList(input, initial = IN[0]):
	if isinstance(initial, list):
		return input
	else:
		return input[0]

# Preparing input from dynamo to revit
eles = uwlist(IN[0])

worksets, names = [],[]

for e in eles:
	doc = e.Document
	if doc.IsWorkshared:
		id = e.WorksetId
		workset = doc.GetWorksetTable().GetWorkset(id)
		worksets.append(workset)
		names.append(workset.Name)
	else:
		worksets.append(None)
		names.append("")

# Preparing output to Dynamo
OUT = objOrList(worksets), objOrList(names)
# ----------------------------------------
code_block = CodeBlock(data=python_script) { wkst = data[0]; nams = data[1]; }
workset = Output(code_block.wkst)  # The element worksets.
name = Output(code_block.nams)  # The workset names.
