# Dynamo custom node ElementsByUniqueId.dyf "© Elements.ByUniqueID" (Dynamo 2.3.0.5885)
# category: Crumple.Revit.Actions
# Given a Unique Id as a string, returns the corresponding element in Revit.

UniqueId = Input(UniqueId: string)  # The element's Unique Id as a string.
code_block = CodeBlock(elemId=UniqueId) { Revit.Elements.ElementSelector.ByUniqueId(elemId); }
elements = Output(code_block)  # Matching Revit elements found, if any.
