# Dynamo custom node ElementsCentroid.dyf "© Elements.Centroid" (Dynamo 2.3.0.5885)
# category: Crumple.Revit.Query
# Returns the centroid of the element's axis-aligned bounding box.

element = Input(element: Revit.Elements.Element)  # Model element(s). Element bounding box will be used to determine the centroid. NB: Axis aligned
boundingBox = Element.BoundingBox(element=element)
minPoint = BoundingBox.MinPoint(boundingBox=boundingBox)
maxPoint = BoundingBox.MaxPoint(boundingBox=boundingBox)
list_create = List.Create(item0=minPoint, item1=maxPoint)
transpose = List.Transpose(lists=list_create)
code_block = CodeBlock(points=transpose) { p = DSCore.Math.Average([points.X,points.Y,points.Z]); Autodesk.Point.ByCoordinates(p[0], p[1], p[2]); }
Centroid = Output(code_block.out1)  # Element BB Centroid as point.
