# Dynamo custom node ElementsCluster.dyf "© Elements.Cluster" (Dynamo 2.12.1.8246)
# category: Crumple.Revit.Actions
# Given a list of elements, determine how they should be grouped based on a proximity radius. The node will collect the centroid of each element (ignoring the Z coordinate) and cluster them based on whether their radii intersect with one another.
# packages: Crumple 2022.2.13

elements = Input(elements: var[]..[])  # Elements to group, in the format of a list.
elements_centroid = Custom[© Elements.Centroid](element=elements)  # package Crumple; Returns the centroid of the element's axis-aligned bounding box.
code_block = CodeBlock(Pt=elements_centroid) { Pt.X; Pt.Y; }
# note: Z is ignored
byCoordinates = Point.ByCoordinates(x=code_block.out0, y=code_block.out1)
proximity = Input(proximity: int = 1500)  # Grouping proximity.
byCenterPointRadius = Circle.ByCenterPointRadius(centerPoint=byCoordinates, radius=proximity)
code_block_2 = CodeBlock { 100; }
extrudeAsSolid = Curve.ExtrudeAsSolid(curve=byCenterPointRadius, distance=code_block_2)
# note: Join together by circle, then intersect with plane to get joined surfaces
byUnion = Solid.ByUnion(solids=extrudeAsSolid)
XY = Plane.XY()
intersect = Geometry.Intersect(geometry=byUnion, other=XY)
# note: Find which unioned surface each point is intersecting with
doesIntersect = Geometry.DoesIntersect(geometry=byCoordinates@L1, other=intersect@L2, lacing=Longest)
code_block_3 = CodeBlock { true; }
indexOf = List.IndexOf(list=doesIntersect@L2, element=code_block_3)
# note: Group elements by their intersecting surface
list_groupbykey_eles = List.GroupByKey(list=elements, keys=indexOf)
clustered = Output(list_groupbykey_eles.groups)  # Grouped elements, in the format of a list of lists.
