# Dynamo custom node ElementsGroup.dyf "© Elements.Group" (Dynamo 2.3.0.5885)
# category: Crumple.Revit.Query
# Returns if an element belongs to a group, and the group itself if it has one.

element = Input(element: var[]..[])
python_script = Python(IN[0]=element)
# ---------- python_script.python (42 lines) ----------
# Made by Gavin Crump
# Free for use
# BIM Guru, www.bimguru.com.au

# Boilerplate text
import clr

clr.AddReference("RevitServices")
import RevitServices
from RevitServices.Persistence import DocumentManager 

clr.AddReference("RevitAPI")
import Autodesk 
from Autodesk.Revit.DB import *

# Current doc/app/ui
doc = DocumentManager.Instance.CurrentDBDocument

# Define list/unwrap list functions
def uwlist(input):
    result = input if isinstance(input, list) else [input]
    return UnwrapElement(result)

# Preparing input from dynamo to revit
items  = uwlist(IN[0])

itemgroup, hasgroup = [], []
	
# Get group and check if has group	
for i in items:
	if hasattr(i, "GroupId"):
		grp = i.Document.GetElement(i.GroupId)
		itemgroup.append(grp)
		if grp:
			hasgroup.append(True)
		else:
			hasgroup.append(False)
	else:
		itemgroup.append(None)

# Preparing output to Dynamo
OUT = [itemgroup, hasgroup]
# ----------------------------------------
code_block = CodeBlock(out=python_script) { out[0]; out[1]; }
group = Output(code_block.out0)
isInGroup = Output(code_block.out1)
