# Dynamo custom node ElementsQuarantine.dyf "© Elements.Quarantine" (Dynamo 2.3.0.5885)
# category: Crumple.Revit.Actions
# Given a list of element lists, exclude elements that wont comply with a given separation from one another. The node will return (one of) the most best possible outcomes for that group of elements.

elements = Input(elements: var[]..[])  # Elements to separate, in the format of a list of lists.
count = Input(count: int = 1500)  # The minimum separation.
# note: Credit to Cyril Poupin for contributing the below Python code
# Shared here via the package for others to use :)
# LINKS
# https://forum.dynamobim.com/u/c.poupin
# https://forum.dynamobim.com/t/covid-chair-spacing-iteration-challenge/57031/6
python_script = Python(IN[0]=elements, IN[1]=count)
# ---------- python_script.python (52 lines) ----------
# Credit to Cyril Poupin for contributing the below Python code
# Shared here via the package for others to use :)

# ORIGINAL THREAD AND USER PROFILE OF C.POUPIN
# https://forum.dynamobim.com/u/c.poupin
# https://forum.dynamobim.com/t/covid-chair-spacing-iteration-challenge/57031/6

# Thanks also to Vikram Subbaiah for his Design script alternative
# https://forum.dynamobim.com/u/Vikram_Subbaiah

# Boilerplate
import clr
clr.AddReference('ProtoGeometry')
from Autodesk.DesignScript.Geometry import *
clr.AddReference('RevitAPI')
import Autodesk
from Autodesk.Revit.DB import *

# Function for reviewing chairs
def nextSpaceChair(group = [], elemA = None, startIdx = 0):
    global margin
    group = list(group)
    if elemA is None: 
        elemA = group.pop(startIdx)
        return [elemA] + nextSpaceChair(group, elemA )
    else:   
        locPt = elemA.Location.Point
        lstPair = [[x, x.Location.Point.DistanceTo(locPt)] for x in group if x.Location.Point.DistanceTo(locPt) > margin]
        lstPair.sort(key = lambda x : x[1])
        if len(lstPair) > 0:
            #get the nearest chair >= 1.50m
            nearElem = lstPair[0][0]
            #get the rest
            group = [x[0] for x in lstPair[1:] ]
            return [nearElem] + nextSpaceChair(group = group, elemA = nearElem )
        else:
            return []   

# Declare inputs
allGroup = list(UnwrapElement(IN[0]))
margin = IN[1] * 0.00328084 #simple convert in feet

# Build outputs
out = []
for g in allGroup:
    # test with change first element, for each chair in group
    testLst = [nextSpaceChair(group = g, elemA = None, startIdx = i) for i in range(len(g))]
    maxlst = max(testLst, key = len)
    out.append(maxlst)

# Declare output
OUT = out
# ----------------------------------------
elements_2 = Output(python_script)  # "elements"; Best configuration.
