# Dynamo custom node ElementsRename.dyf "© Elements.Rename" (Dynamo 2.12.1.8246)
# category: Crumple.Revit.Actions
# For an element or list of elements, attempt to set the value of a given parameter (by default Name).

elements = Input(elements: var[]..[])
values = Input(values: var[]..[])
parameterName = Input(parameterName: string = "Name")
python_script = Python(IN[0]=elements, IN[1]=values, IN[2]=parameterName)  # IronPython2
# ---------- python_script.python (68 lines) ----------
# Made by Gavin Crump
# Free for use
# BIM Guru, www.bimguru.com.au

# Boilerplate text
import clr

clr.AddReference("RevitServices")
import RevitServices
from RevitServices.Persistence import DocumentManager 
from RevitServices.Transactions import TransactionManager 

# Current doc/app/ui
doc = DocumentManager.Instance.CurrentDBDocument

# Define list/unwrap list functions
def tolist(input):
    result = input if isinstance(input, list) else [input]
    return result

def uwlist(input):
    result = input if isinstance(input, list) else [input]
    return UnwrapElement(result)

def objOrList(input, initial = IN[0]):
	if isinstance(initial, list):
		return input
	else:
		return input[0]

# Preparing input from dynamo to revit
elements = uwlist(IN[0])
names    = tolist(IN[1])
param    = IN[2]

results,sucess = [],[]

# Do some action in a Transaction
TransactionManager.Instance.EnsureInTransaction(doc)

for e,n in zip(elements,names):
	
	try:
		ename = e.LookupParameter(param)
		eval  = ename.AsString()
	
		if eval != n:

			try:
				e.Name = n
				results.append("SUCCESS: Element renamed.")
				sucess.append(True)
			except:
				results.append("FAILURE: Element not renamed..")
				sucess.append(False)
		
		else:
			results.append("SKIPPED: Name is the same.")
			sucess.append(False)
			
	except:
		results.append("ERROR: Parameter by that name not found.")
		results.append(False)

TransactionManager.Instance.TransactionTaskDone()

# Preparing output to Dynamo
OUT = [objOrList(o) for o in [elements, sucess, results]]
# ----------------------------------------
code_block = CodeBlock(x=python_script) { x[0]; x[1]; x[2]; }
elements_2 = Output(code_block.out0)  # "elements"
wasRenamed = Output(code_block.out1)
outcomes = Output(code_block.out2)
