# Dynamo custom node ElementsSelect.dyf "© Elements.Select" (Dynamo 2.12.1.8246)
# category: Crumple.Revit.Actions
# Given a list of elements, select them in the Revit document.

elements = Input(elements: var[]..[])
python_script = Python(IN[0]=elements)  # IronPython2
# ---------- python_script.python (48 lines) ----------
# Made by Gavin Crump
# Free for use
# BIM Guru, www.bimguru.com.au

# Boilerplate text
import clr

import System
from System.Collections.Generic import List

clr.AddReference("RevitServices")
import RevitServices
from RevitServices.Persistence import DocumentManager 

clr.AddReference("RevitAPI")
import Autodesk 
from Autodesk.Revit.DB import ElementId

# Current doc/app/ui
doc = DocumentManager.Instance.CurrentDBDocument
uiapp = DocumentManager.Instance.CurrentUIApplication 
uidoc = uiapp.ActiveUIDocument

# Define list/unwrap list functions
def uwlist(input):
    result = input if isinstance(input, list) else [input]
    return UnwrapElement(input)

# Preparing input from dynamo to revit
uw_list    = uwlist(IN[0])

idsCheck   = []
elementIds = List[ElementId]()

# Select elements
for e in uw_list:
	try:
		eid = e.Id.ToString()
	except:
		eid = None
	if eid not in idsCheck and eid:
		elementIds.Add(e.Id)
		idsCheck.append(eid)

selection = uidoc.Selection.SetElementIds(elementIds)

# Preparing output to Dynamo
OUT = True
# ----------------------------------------
wasRun = Output(python_script)
