# Dynamo custom node ElementsStatus.dyf "© Elements.Status" (Dynamo 2.12.1.8246)
# category: Crumple.Revit.Query
# Returns the checkout and model update status of elements if the model is workshared.

elements = Input(elements: var[]..[])
python_script = Python(IN[0]=elements)  # IronPython2
# ---------- python_script.python (39 lines) ----------
# Made by Gavin Crump
# Free for use
# BIM Guru, www.bimguru.com.au

# Boilerplate text
import clr

clr.AddReference("RevitServices")
import RevitServices
from RevitServices.Persistence import DocumentManager 

clr.AddReference("RevitAPI")
import Autodesk 
from Autodesk.Revit.DB import WorksharingUtils

# Current doc/app/ui
doc = DocumentManager.Instance.CurrentDBDocument

# Define list/unwrap list functions
def uwlist(input):
    result = input if isinstance(input, list) else [input]
    return UnwrapElement(result)

# Preparing input from dynamo to revit
elements = uwlist(IN[0])

checkout_status, update_status = [],[]

# Do some action in a Transaction
if doc.IsWorkshared:
	for e in elements:
		checkout_status.append(WorksharingUtils.GetCheckoutStatus(doc, e.Id))
		update_status.append(WorksharingUtils.GetModelUpdatesStatus(doc, e.Id))
else:
	for e in elements:
		checkout_status.append(None)
		update_status.append(None)

OUT = checkout_status, update_status
# ----------------------------------------
code_block = CodeBlock(out=python_script) { out[0]; out[1]; }
checkoutStatus = Output(code_block.out0)
modelUpdateStatus = Output(code_block.out1)
