# Dynamo custom node ElementsWorksets.dyf "© Elements.Workset" (Dynamo 2.12.1.8246)
# category: Crumple.Revit.Query
# Given a list of elements, return their associated workset, its name and a unique list of workset names belonging to that list of elements.
# packages: Crumple 2022.2.13

elements = Input(elements: var[]..[])  # Elements to inspect.
docOrLink = Input(docOrLink: var[]..[] = null)  # Uses current if none provided. Accepts document or link instance.
revit_getdocument = Custom[© Revit.GetDocument](docOrLink=docOrLink)  # package Crumple; If no input is specified or an invalid one is, returns current document. If a link instance is provided, it returns the linked document. If a document is provided it will pass it through.
python_script = Python(IN[0]=elements, IN[1]=revit_getdocument.document)  # IronPython2
# ---------- python_script.python (31 lines) ----------
# Made by Gavin Crump
# Free for use
# BIM Guru, www.bimguru.com.au

# Boilerplate text
import clr

# Current doc/app/ui
doc = IN[1]

# Define list/unwrap list functions
def uwlist(input):
    result = input if isinstance(input, list) else [input]
    return UnwrapElement(result)

# Preparing input from dynamo to revit
eles = uwlist(IN[0])

if doc.IsWorkshared:
	# Variables to build
	worksets, names = [],[]
	# Get element workset properties
	for e in eles:
		id = e.WorksetId
		workset = doc.GetWorksetTable().GetWorkset(id)
		worksets.append(workset)
		names.append(workset.Name)
	# Preparing output to Dynamo
	OUT = worksets, names
else:
	OUT = [None for e in eles], ["" for e in eles]
# ----------------------------------------
code_block = CodeBlock(data=python_script) { wkst = data[0]; nams = data[1]; }
worksets = Output(code_block.wkst)  # The element worksets.
names = Output(code_block.nams)  # The workset names.
