# Dynamo custom node ExcelPandasRead.dyf "© Excel.Read 🐼" (Dynamo 2.12.1.8246)
# category: Crumple.Application.Actions
# Given a excel file path, will attempt to read its contents using the pandas library. If your pandas is not valid or found, nothing will be returned.

filePath = Input(filePath: string)
workSheet = Input(workSheet: string)  # If not found, reads the first sheet
readAsStrings = Input(readAsStrings: bool = true)
replaceNulls = Input(replaceNulls: var = "")
python_script = Python(IN[0]=filePath, IN[1]=workSheet, IN[2]=readAsStrings, IN[3]=replaceNulls)  # CPython3
# ---------- python_script.python (66 lines) ----------
# Made by Gavin Crump
# Free for use
# BIM Guru, www.bimguru.com.au

# Import pandas
try:
	import pandas as pd
	filePath  = IN[0]
	xcl = pd.ExcelFile(filePath)
	pandasFound = True
except:
	pandasFound = False

# If we found pandas...
if pandasFound == True:
	# Inputs from Dynamo
	sheetName = IN[1]
	asStrings = IN[2]
	fillNan   = IN[3]
	# Initial variable states
	wasRead  = False
	wasFound = False
	# Get sheet names
	sheetNames = xcl.sheet_names
	# If sheet name not found, get first sheet
	if sheetName not in sheetNames:
		sheetName = sheetNames[0]
	# Otherwise we found the sheet
	else:
		wasFound = True
	# If read as strings...
	if asStrings:
		# Try to get data as df to lol
		try:
			df = pd.read_excel(filePath,\
					   header=None,
					   dtype = str,
					   sheet_name=sheetName)
			df.fillna(fillNan, inplace=True)
			dataOut = df.values.tolist()
			wasRead = True
			msgOut = "SUCCESS: Excel file was read."
		# Otherwise return nothing
		except:
			dataOut = None
			msgOut = "SUCCESS: Excel file not read."
	# Otherwise, read as is
	else:
		# Try to get data as df to lol
		try:
			df = pd.read_excel(filePath,\
					   header=None,
					   sheet_name=sheetName)
			df.fillna(fillNan, inplace=True)
			dataOut = df.values.tolist()
			wasRead = True
			msgOut = "SUCCESS: Excel file was read."
		# Otherwise return nothing
		except:
			dataOut = None
			msgOut = "SUCCESS: Excel file not read."
	# Outputs to Dynamo
	OUT = dataOut, wasRead, wasFound, msgOut
# Otherwise, return nothing
else:
	OUT = None, False, False, "ERROR: pandas not found/valid."
# ----------------------------------------
code_block = CodeBlock(x=python_script) { x[0]; x[1]; x[2]; x[3]; }
excelData = Output(code_block.out0)
wasRead = Output(code_block.out1)
wasFound = Output(code_block.out2)
errorReport = Output(code_block.out3)
