# Dynamo custom node FamilyDocClose.dyf "© FamilyDoc.Close" (Dynamo 2.12.1.8246)
# category: Crumple.Revit.Actions
# Given documents in the unwrapped state, attempts to close then with the option to save them (applies to all documents, one input expected, not a list).

familyDocs = Input(familyDocs: var[]..[])  # A family document or list of family documents.
saveOption = Input(saveOption: bool = false)
python_script = Python(IN[0]=familyDocs, IN[1]=saveOption)  # IronPython2
# ---------- python_script.python (27 lines) ----------
# Made by Gavin Crump
# Free for use
# BIM Guru, www.bimguru.com.au

# Boilerplate text
import clr

# Define list/unwrap list functions
def tolist(input):
    result = input if isinstance(input, list) else [input]
    return result

# Current doc/app/ui
docs     = tolist(IN[0])
saveOpt  = IN[1]
outcomes = []

# Do some action in a Transaction
for doc in docs:
	try:
		doc.Close(saveOpt)
		outcomes.append(True)
	except:
		outcomes.append(False)

# Preparing output to Dynamo
OUT = outcomes
# ----------------------------------------
wasClosed = Output(python_script)
