# Dynamo custom node FamilyDocParameters.dyf "© FamilyDoc.Parameters" (Dynamo 2.3.1.11775)
# category: Crumple.Revit.Query
# Obtains all parameters in a family document, as well as their properties.
# packages: Crumple 2022.2.13

familyDocument = Input(familyDocument: var[]..[] = null)  # Uses current if none provided.
revit_getdocument = Custom[© Revit.GetDocument](docOrLink=familyDocument)  # package Crumple; If no input is specified or an invalid one is, returns current document. If a link instance is provided, it returns the linked document. If a document is provided it will pass it through.
document_parameters = Python(IN[0]=revit_getdocument.document)
# ---------- document_parameters.python (33 lines) ----------
# Made by Gavin Crump
# Free for use
# BIM Guru, www.bimguru.com.au

#Credit to Joshua Budarick for his assistance with this workflow!
# https://www.linkedin.com/in/joshua-budarick-9bb50b4b/

# Boilerplate text
import clr
clr.AddReference('RevitAPI')
from Autodesk.Revit.DB import *

clr.AddReference("RevitServices")
import RevitServices
from RevitServices.Persistence import DocumentManager 

#Inputdoc
doc = IN[0]

# Define lists
p_ele, p_nam, p_grp, p_sha, p_ins = [],[],[],[],[]

# Collect values
if doc.IsFamilyDocument:
	for param in doc.FamilyManager.Parameters:
		p_ele.append(param)
		p_nam.append(param.Definition.Name)
		p_sha.append(param.IsShared)
		p_ins.append(param.IsInstance)
		p_grp.append(param.Definition.ParameterGroup)
	OUT = [p_ele, p_nam, p_grp, p_sha, p_ins]
else:
	OUT = ["Document is not a family."]
# ----------------------------------------
code_block = CodeBlock(out=document_parameters) { ele = out[0]; nam = out[1]; grp = out[2]; sha = out[3]; ins = out[4]; }
elements = Output(code_block.ele)  # The parameters as elements
names = Output(code_block.nam)  # The names of the parameters
groups = Output(code_block.grp)  # The parameter groups
isShared = Output(code_block.sha)  # Is the parameter shared?
isInstance = Output(code_block.ins)  # Is the parameter instance based?
