# Dynamo custom node FamilyDocRemoveParameters.dyf "© FamilyDoc.RemoveParameters" (Dynamo 2.12.1.8246)
# category: Crumple.Revit.Create
# Given a family document or list of them, attempts to remove parameters in them. Input structures should be in the form of one sub-list per family document, in a list (but the node will try to create this data structure if not, as well as repeat the last list if they are shorter than the family document list).
# packages: Crumple 2024.3.1

familyDocs = Input(familyDocs: var[]..[])  # A family document or list of family documents. If multiple family documents, you should provide a list of list with branches equal to the family documents. If you do not the node will apply longest lacing to the last list for each excess family document.
nameOrTypeLists = Input(nameOrTypeLists: var[]..[])  # Lists of family parameters or parameter names. (per family document, ideally)
list_graftbyprimary = Custom[© List.GraftByPrimary](primary=familyDocs, listA=nameOrTypeLists)  # package Crumple; Given a first input, the node will assess how many items it contains (if one, it will make it a list of 1 item). Remaining branches will be forced into a list of lists, where the last branch will be repeated to a longest length as the first list (if one list or item is provided, it will repeat as the list of lists).
python_script_remove_parameters = Python(IN[0]=list_graftbyprimary.primary, IN[1]=list_graftbyprimary.listA)  # IronPython2
# ---------- python_script_remove_parameters.python (76 lines) ----------
# Made by Gavin Crump
# Free for use
# BIM Guru, www.bimguru.com.au

# Boilerplate text
import clr

clr.AddReference("RevitServices")
import RevitServices
from RevitServices.Persistence import DocumentManager 
from RevitServices.Transactions import TransactionManager 

clr.AddReference("RevitAPI")
import Autodesk 
from Autodesk.Revit.DB import FamilyManager, Parameter, Definition, Transaction

# Function to get parameter or by name
def tryByName(var, params, names):
	if isinstance(var, str):
		for p,n in zip(params, names):
			if n == var:
				return p
		return None
	else:
		return var

# Function to remove parameter
def famDoc_removeParameter(familyManager, famPar):
	if not famPar:
		return False
	else:
		try:
			familyManager.RemoveParameter(famPar)
			return True
		except:
			return False

# Inputs
doc_list   = IN[0]
paramLists = IN[1]

results = []

# For each document and its parameter lists...
for doc, paramList in zip(doc_list, paramLists):
	
	result = []
	famMan = doc.FamilyManager
	
	# "Start" the transaction
	t = Transaction(doc, "Remove parameters")
	t.Start()
	
	#TransactionManager.Instance.EnsureInTransaction(doc)
	
	# Get all parameters and their names
	famParams = famMan.Parameters
	parNames  = [p.Definition.Name for p in famParams]
	# Try to get parameters from names
	parsGet = [tryByName(p,famParams,parNames) for p in paramList]
	
	# For each parameter...
	for p in parsGet:
		
		# Try to remove parameter
		removed = famDoc_removeParameter(famMan, p)
		result.append(removed)
	
	# "End" the transaction
	t.Commit()
	
	# Append to results
	results.append(result)

# Preparing output to Dynamo
OUT = doc_list, results
# ----------------------------------------
code_block = CodeBlock(OUT=python_script_remove_parameters) { docs = OUT[0]; rslt = OUT[1]; }
familyDocs_2 = Output(code_block.docs)  # "familyDocs"; The original family document(s).
Lists_of_outcomes_list_per_family_docume = Output(code_block.rslt)  # "/*Lists of outcomes (list per family document). True if success, false if not.*/ resultLists"
