# Dynamo custom node FamilyDocReplaceWithSharedParameters.dyf "© FamilyDoc.ReplaceWithSharedParameters" (Dynamo 2.12.1.8246)
# category: Crumple.Revit.Create
# Given a family document or list of documents, as well as family parameters and shared parameter definitions, this node will attempt to replace the parameters.
# packages: Crumple 2024.3.1

familyDocs = Input(familyDocs: var[]..[])  # A family document or list of family documents. If multiple family documents, you should provide a list of list with branches equal to the family documents. If you do not the node will apply longest lacing to the last list for each excess family document.
parLists = Input(parLists: var[]..[])  # Lists of parameters. (per family document, ideally)
exDefLists = Input(exDefLists: var[]..[])  # Lists of external definitions. (per family document, ideally)
list_graftbyprimary = Custom[© List.GraftByPrimary](primary=familyDocs, listA=parLists, listB=exDefLists)  # package Crumple; Given a first input, the node will assess how many items it contains (if one, it will make it a list of 1 item). Remaining branches will be forced into a list of lists, where the last branch will be repeated to a longest length as the first list (if one list or item is provided, it will repeat as the list of lists).
python_script_replace_parameters = Python(IN[0]=list_graftbyprimary.primary, IN[1]=list_graftbyprimary.listA, IN[2]=list_graftbyprimary.listB)  # IronPython2
# ---------- python_script_replace_parameters.python (88 lines) ----------
# Made by Gavin Crump
# Free for use
# BIM Guru, www.bimguru.com.au

# Boilerplate text
import clr

clr.AddReference("RevitServices")
import RevitServices
from RevitServices.Persistence import DocumentManager
from RevitServices.Transactions import TransactionManager

clr.AddReference('RevitAPI')
import Autodesk 
from Autodesk.Revit.DB import FamilyManager, Transaction

# Get Revit build version
uiapp = DocumentManager.Instance.CurrentUIApplication
app = uiapp.Application
ver = int(app.VersionNumber)

if ver > 2023:
	from Autodesk.Revit.DB import ParameterUtils

# Function to get forge type Id if in 2024
def getParGroup(par):
	if ver > 2023:
		return par.Definition.GetGroupTypeId()
	else:
		return par.Definition.ParameterGroup

# Function to replace parameter
def familyDoc_replaceParameter(famMan, par, exDef, myDoc):
	# If no parameter or def, we pass
	if not par or not exDef:
		return None, False
	# Convert parGrp
	parGrp = getParGroup(par)
	parInst = par.IsInstance
	# If parameter is shared, > family > shared
	if par.IsShared:
		try:
			par = famMan.ReplaceParameter(par, "__Temp", parGrp, parInst)
			par = famMan.ReplaceParameter(par, exDef, parGrp, parInst)
			return par, True
		except:
			return None, False
	# Otherwise, > shared
	else:
		try:
			par = famMan.ReplaceParameter(par, exDef, parGrp, par.IsInstance)
			return par, True
		except:
			return None, False

#unwrap all elements to use with API
docs_list = IN[0]
pars_list = IN[1]
defs_list = IN[2]

pars_out, results = [],[]

# Collect values
for doc, pars, defs in zip(docs_list, pars_list, defs_list):
	
	# Result lists, family manager
	fam_pars, result = [],[]
	famMan = doc.FamilyManager
	
	# For each definition/parameter
	for d,p in zip(defs, pars):
		
		# Try to replace parameter
		with Transaction(doc, 'Replace parameters') as t:
			t.Start()
			par, res = familyDoc_replaceParameter(famMan, p, d, doc)
			t.Commit()
		
		# Append the result
		fam_pars.append(par)
		result.append(res)
	
	# Append the results
	pars_out.append(fam_pars)
	results.append(result)

# Outputs to Dynamo
OUT = docs_list, pars_out, results
# ----------------------------------------
code_block = CodeBlock(out=python_script_replace_parameters) { docs = out[0]; pars = out[1]; resl = out[2]; }
familyDocs_2 = Output(code_block.docs)  # "familyDocs"; The original family document(s).
Lists_of_parameters_replaced_list_per_fa = Output(code_block.pars)  # "/*Lists of parameters replaced (list per family document). Failures will return a null.*/ parameterLists"
Lists_of_outcomes_list_per_family_docume = Output(code_block.resl)  # "/*Lists of outcomes (list per family document). True if success, false if not.*/ resultLists"
