# Dynamo custom node FamilyDocTypes.dyf "© FamilyTypes" (Dynamo 2.3.1.11775)
# category: Crumple.Revit.FamilyDocument
# Returns all family types in the current document.

refresh = Input(refresh: bool = true)
python_script = Python(IN[0]=refresh)
# ---------- python_script.python (24 lines) ----------
# Made by Gavin Crump
# Free for use
# BIM Guru, www.bimguru.com.au

# Boilerplate text
import clr

clr.AddReference("RevitServices")
import RevitServices
from RevitServices.Persistence import DocumentManager 

clr.AddReference("RevitAPI")
import Autodesk 
from Autodesk.Revit.DB import *

# Current doc/app/ui
doc = DocumentManager.Instance.CurrentDBDocument

# Preparing input from dynamo to revit
fam_types = doc.FamilyManager.Types
fam_names = [f.Name for f in fam_types]

# Preparing output to Dynamo
OUT = [fam_types, fam_names]
# ----------------------------------------
code_block = CodeBlock(x=python_script) { x[0]; x[1]; }
familyTypes = Output(code_block.out0)
typeNames = Output(code_block.out1)
