# Dynamo custom node FamilyInstanceRotation.dyf "© Family.InstanceRotation" (Dynamo 2.12.1.8246)
# category: Crumple.Revit.Query
# Returns the rotation of both point and line based elements. Not as thorough as other nodes out there, but a bit faster and robust when you know your elements are likely family instances.

familyInstance = Input(familyInstance: var[]..[])
python_script = Python(IN[0]=familyInstance)  # IronPython2
# ---------- python_script.python (52 lines) ----------
# Made by Gavin Crump
# Free for use
# BIM Guru, www.bimguru.com.au

# Boilerplate text
import clr
import math

clr.AddReference("RevitNodes")
import Revit
clr.ImportExtensions(Revit.GeometryConversion)

clr.AddReference("RevitAPI")
import Autodesk 
from Autodesk.Revit.DB import LocationPoint, LocationCurve

# Define list/unwrap list functions
def uwlist(input):
    result = input if isinstance(input, list) else [input]
    return UnwrapElement(input)

# Preparing input from dynamo to revit
uw_list  = uwlist(IN[0])
angles,bools,pts = [],[],[]

# Try to get element rotation
for i in uw_list:
	# See if item has a location
	if hasattr(i, "Location"):
		loc = i.Location
		# Check if it is is a point
		if isinstance(loc, LocationPoint):
			rot = math.degrees(loc.Rotation)
			angles.append(round(rot,3))
			bools.append(True)
		# Check if it is is a line
		elif isinstance(loc,LocationCurve):
			vec = loc.Curve.Direction
			rot = math.degrees(vec.AngleOnPlaneTo(XYZ.BasisX, XYZ.BasisZ))
			angles.append(round(rot,3))
			bools.append(True)
		# None of the above
		else:
			angles.append(None)
			bools.append(False)
	# Item has no location
	else:
		angles.append(None)
		bools.append(False)

# Preparing output to Dynamo
OUT = angles, bools
# ----------------------------------------
code_block = CodeBlock(out=python_script) { angles = out[0]; bools  = out[1]; }
angle = Output(code_block.angles)
hasAngle = Output(code_block.bools)
