# Dynamo custom node FamilyInstancesByViewAndPoint.dyf "© Family.InstanceByViewAndPoint" (Dynamo 2.12.1.8246)
# category: Crumple.Revit.Create
# Given a family type, list of views and list of points, attempts to create family instances at those points in those views.

familyType = Input(familyType: Revit.Elements.FamilyType)
view = Input(view: Revit.Elements.Views.View)
points = Input(points: var[]..[])
python_script = Python(IN[0]=familyType, IN[1]=view, IN[2]=points)  # IronPython2
# ---------- python_script.python (43 lines) ----------
# Boilerplate text
import clr

clr.AddReference("RevitNodes")
import Revit
clr.ImportExtensions(Revit.Elements)
clr.ImportExtensions(Revit.GeometryConversion)

clr.AddReference("RevitServices")
import RevitServices
from RevitServices.Persistence import DocumentManager
from RevitServices.Transactions import TransactionManager

# Current doc/app/ui
doc = DocumentManager.Instance.CurrentDBDocument

# Define list/unwrap list functions
def uwlist(input):
    result = input if isinstance(input, list) else [input]
    return UnwrapElement(result)

# Preparing input from dynamo to revit
famtype  = UnwrapElement(IN[0])
view    =  UnwrapElement(IN[1])
points   = uwlist(IN[2])

elementlist = []

# Do some action in a Transaction
TransactionManager.Instance.EnsureInTransaction(doc)

if famtype.IsActive == False:
	famtype.Activate()
	doc.Regenerate()

for p in points:
	newFam = doc.Create.NewFamilyInstance(p.ToXyz(), famtype, view)
	elementlist.append(newFam.ToDSType(True))
    
TransactionManager.Instance.TransactionTaskDone()

# Preparing output to Dynamo
OUT = elementlist
# ----------------------------------------
familyInstances = Output(python_script)
