# Dynamo custom node FamilyParamParameterGroup.dyf "© FamilyParam.ParameterGroup" (Dynamo 2.12.1.8246)
# category: Crumple.Revit.Query
# For a family parameter of list of them, returns their parmater groups. If using Revit 2024+ the node will return ForgeTypeIds instead.

familyParams = Input(familyParams: var[]..[])  # Lists of family parameters.
python_script_get_data = Python(IN[0]=familyParams)  # IronPython2
# ---------- python_script_get_data.python (47 lines) ----------
# Made by Gavin Crump
# Free for use
# BIM Guru, www.bimguru.com.au

# Boilerplate text
import clr

clr.AddReference("RevitServices")
import RevitServices
from RevitServices.Persistence import DocumentManager 

clr.AddReference('RevitAPI')
import Autodesk 
from Autodesk.Revit.DB import FamilyManager, Parameter

# Get Revit build version
uiapp = DocumentManager.Instance.CurrentUIApplication
app = uiapp.Application
ver = int(app.VersionNumber)

if ver > 2023:
	from Autodesk.Revit.DB import ParameterUtils

# Function: Get param group
def parameterGroup(par):
	parGrp = param.Definition.ParameterGroup
	if ver > 2023:
		return ParameterUtils.GetParameterGroupTypeId(parGrp)
	else:
		return parGrp

# Define list/unwrap list functions
def tolist(input):
    result = input if isinstance(input, list) else [input]
    return result

def objOrList(input, initial = IN[0]):
	if isinstance(initial, list):
		return input
	else:
		return input[0]

#Inputdoc
params_list = tolist(IN[0])

# Output the lists
OUT = objOrList([parameterGroup(param) for param in params_list])
# ----------------------------------------
Parameter_groups_Will_return_as_GroupTyp = Output(python_script_get_data)  # "/*Parameter groups. Will return as GroupTypeIds if you are using Revit 2024+.*/ parameterGroups"
