# Dynamo custom node FamilyParamStorageType.dyf "© FamilyParam.StorageType" (Dynamo 2.12.1.8246)
# category: Crumple.Revit.Query
# For a family parameter or list of them, return their storage types.

familyParams = Input(familyParams: var[]..[])  # Lists of family parameters.
python_script_get_data = Python(IN[0]=familyParams)  # IronPython2
# ---------- python_script_get_data.python (27 lines) ----------
# Made by Gavin Crump
# Free for use
# BIM Guru, www.bimguru.com.au

# Boilerplate text
import clr

clr.AddReference('RevitAPI')
import Autodesk 
from Autodesk.Revit.DB import Parameter

# Define list/unwrap list functions
def tolist(input):
    result = input if isinstance(input, list) else [input]
    return result

def objOrList(input, initial = IN[0]):
	if isinstance(initial, list):
		return input
	else:
		return input[0]

#Inputdoc
params_list = tolist(IN[0])

# Output the lists
OUT = objOrList([param.StorageType for param in params_list])
# ----------------------------------------
Parameter_storage_type_storageTypes = Output(python_script_get_data)  # "/*Parameter storage type.*/ storageTypes"
