# Dynamo custom node FamilyTypeName.dyf "© FamilyType.Name" (Dynamo 2.12.1.8246)
# category: Crumple.Revit.Query
# For a family type or list of family types, returns the type names.

familyTypes = Input(familyTypes: var[]..[])  # Lists of family types.
python_script_get_names = Python(IN[0]=familyTypes)  # IronPython2
# ---------- python_script_get_names.python (23 lines) ----------
# Made by Gavin Crump
# Free for use
# BIM Guru, www.bimguru.com.au

# Boilerplate text
import clr

# Define list/unwrap list functions
def tolist(input):
    result = input if isinstance(input, list) else [input]
    return result

def objOrList(input, initial = IN[0]):
	if isinstance(initial, list):
		return input
	else:
		return input[0]

#Inputdoc
types_list = tolist(IN[0])

# Output the lists
OUT = objOrList([t.Name for t in types_list])
# ----------------------------------------
Type_names_typeNames = Output(python_script_get_names)  # "/*Type names.*/ typeNames"
