# Dynamo custom node FlowGate.dyf "© Flow.Gate" (Dynamo 2.3.1.11775)
# category: Crumple.Script.Actions
# Unless a true value is provided, sends across an empty list instead of an input stream.

toggle = Input(toggle: var[]..[])
data = Input(data: var[]..[])
python_script = Python(IN[0]=toggle, IN[1]=data)
# ---------- python_script.python (8 lines) ----------
# Made by Gavin Crump
# Free for use
# BIM Guru, www.bimguru.com.au

if IN[0] != False:
	OUT = IN[1]
else:
	OUT = []
# ----------------------------------------
output = Output(python_script)
