# Dynamo custom node GetSpaceType.dyf "© GetSpaceType" (Dynamo 2.3.0.5885)
# category: Crumple.Revit.Spaces
# Gets a Space's Type as well as it's name and Id.

spaces = Input(spaces: var[]..[])  # A space or list of spaces.
python_script = Python(IN[0]=spaces)
# ---------- python_script.python (40 lines) ----------
# Made by Gavin Crump
# Free for use
# BIM Guru, www.bimguru.com.au

# Boilerplate text
import clr

clr.AddReference("RevitNodes")
import Revit
clr.ImportExtensions(Revit.Elements)

clr.AddReference("RevitServices")
import RevitServices
from RevitServices.Persistence import DocumentManager 

clr.AddReference("RevitAPI")
from Autodesk.Revit.DB import *

# Current doc/app/ui
doc = DocumentManager.Instance.CurrentDBDocument

# Preparing input from dynamo to revit
elements = IN[0] if isinstance(IN[0], list) else [IN[0]]

# Prepare empty lists
eles, names, ids = [], [], []

# Find space type Id and convert to element
for e in elements:
	uw = UnwrapElement(e)
	id_uwr = uw.SpaceTypeId
	spt = doc.GetElement(id_uwr).ToDSType(True)
	eles.append(spt)
	names.append(spt.Name)
	id_str = id_uwr.ToString()
	id_int = int(id_str)
	ids.append(id_int)

# Preparing output to Dynamo
OUT = [eles, names, ids]
# ----------------------------------------
code_block = CodeBlock(lst=python_script) { st = lst[0]; nm = lst[1]; ID = lst[2]; }
space_type = Output(code_block.st)  # As an element.
type_name = Output(code_block.nm)  # As a string.
type_id = Output(code_block.ID)  # As an integer.
