# Dynamo custom node GetWarnings.dyf "© GetWarnings" (Dynamo 2.3.0.5885)
# category: Crumple.Revit.Warnings
# Returns all warnings in the Revit model in their Revit db format (will work with other warning nodes from this package).

refresh = Input(refresh: bool = true)
python_script = Python(IN[0]=refresh)
# ---------- python_script.python (16 lines) ----------
# Made by Gavin Crump
# Free for use
# BIM Guru, www.bimguru.com.au

# Boilerplate text
import clr

clr.AddReference("RevitServices")
import RevitServices
from RevitServices.Persistence import DocumentManager 

# Current doc/app/ui
doc = DocumentManager.Instance.CurrentDBDocument

# Preparing output to Dynamo
OUT = doc.GetWarnings()
# ----------------------------------------
warnings = Output(python_script)
