# Dynamo custom node GroupElements.dyf "© Groups.Elements" (Dynamo 2.3.0.5885)
# category: Crumple.Revit.Actions
# Given a Revit group, return all elements in that given group if any.

group = Input(group: var[]..[])
python_script = Python(IN[0]=group)
# ---------- python_script.python (39 lines) ----------
# Made by Gavin Crump
# Free for use
# BIM Guru, www.bimguru.com.au

# Boilerplate text
import clr

clr.AddReference("RevitServices")
import RevitServices
from RevitServices.Persistence import DocumentManager 

clr.AddReference("RevitAPI")
import Autodesk 
from Autodesk.Revit.DB import *

# Current doc/app/ui
doc = DocumentManager.Instance.CurrentDBDocument

# Define list/unwrap list functions
def uwlist(input):
    result = input if isinstance(input, list) else [input]
    return UnwrapElement(result)

# Preparing input from dynamo to revit
groups  = uwlist(IN[0])
elementslist = []

# Get elements in groups
for grp in groups:
	try:
		elementlist = []
		for e in grp.GetMemberIds():
			elementlist.append(grp.Document.GetElement(e))
		elementslist.append(elementlist)
	except:
		elementslist.append([])

# Preparing output to Dynamo
OUT = elementslist
# ----------------------------------------
elements = Output(python_script)
