# Dynamo custom node GroupHasExclusions.dyf "© Groups.HasExclusions" (Dynamo 2.12.1.8246)
# category: Crumple.Revit.Query
# Returns a boolean as to whether a group contains excluded elements.

groups = Input(groups: var[]..[])
python_script = Python(IN[0]=groups)  # IronPython2
# ---------- python_script.python (27 lines) ----------
# Boilerplate text
import clr

def uwlist(input):
    result = input if isinstance(input, list) else [input]
    return UnwrapElement(result)

def objOrList(input):
    if isinstance(input, list) and len(input) == 1:
        return input[0]
    else:
        return input

# Preparing input from dynamo to revit
groups = uwlist(IN[0])

excluded = []

# Check for excluded elements
for group in groups:
	if "excluded" in group.Name:
		excluded.append(True)
	else:
		excluded.append(False)

# Preparing output to Dynamo
OUT = objOrList(excluded)
# ----------------------------------------
hasExcluded = Output(python_script)
