# Dynamo custom node LevelGetByName.dyf "© LevelGetByName" (Dynamo 2.3.0.5885)
# category: Crumple.Revit.Levels
# Given a list of names, returns the matching levels (if they exist).

names = Input(names: var[]..[])
python_script = Python(IN[0]=names)
# ---------- python_script.python (42 lines) ----------
# Made by Gavin Crump
# Free for use
# BIM Guru, www.bimguru.com.au

# Boilerplate text
import clr

clr.AddReference("RevitServices")
import RevitServices
from RevitServices.Persistence import DocumentManager 

clr.AddReference("RevitAPI")
import Autodesk 
from Autodesk.Revit.DB import *

# Current doc/app/ui
doc = DocumentManager.Instance.CurrentDBDocument

# Define list/unwrap list functions
def tolist(input):
    result = input if isinstance(input, list) else [input]
    return result

# Preparing input from dynamo to revit
names_in   = tolist(IN[0])
levels_out = []

# Get all levels in document
levels_all = FilteredElementCollector(doc).OfCategory(BuiltInCategory.OST_Levels).WhereElementIsNotElementType().ToElements()
names_all  = [l.Name for l in levels_all]

# Get matching levels by number
for n in names_in:
	try:
		ind = names_all.index(n)
		lvl = levels_all[ind]
		levels_out.append(lvl)
	except:
		levels_out.append(None)

# Preparing output to Dynamo
OUT = levels_out
# ----------------------------------------
levels = Output(python_script)
