# Dynamo custom node LinePatterns.dyf "© LinePatterns" (Dynamo 2.3.0.5885)
# category: Crumple.Revit.GraphicStyles
# Returns all line patterns in the current document.

Refresh = Input(Refresh: bool = true)  # Toggle to refresh
python_script = Python(IN[0]=Refresh)
# ---------- python_script.python (26 lines) ----------
# Made by Gavin Crump
# Free for use
# BIM Guru, www.bimguru.com.au

# Boilerplate text
import clr

clr.AddReference('RevitAPI')
from Autodesk.Revit.DB import *
import Autodesk

clr.AddReference("RevitServices")
import RevitServices
from RevitServices.Persistence import DocumentManager

# Current document
doc = DocumentManager.Instance.CurrentDBDocument

bool = IN[0]

collector = FilteredElementCollector(doc)
allLinePatterns = collector.OfClass(LinePatternElement).ToElements()

Names = [UnwrapElement(p).Name for p in allLinePatterns]

OUT = [allLinePatterns, Names]
# ----------------------------------------
code_block = CodeBlock(out=python_script) { ele = out[0]; nam = out[1]; }
elements = Output(code_block.ele)  # The patterns as elements
names = Output(code_block.nam)  # The names of the patterns
