# Dynamo custom node LineStyles.dyf "© LineStyles" (Dynamo 2.3.0.5885)
# category: Crumple.Revit.GraphicStyles
# Returns all the line styles in the model and their names.

Refresh = Input(Refresh: bool = true)  # Toggle to refresh
python_script = Python(IN[0]=Refresh)
# ---------- python_script.python (29 lines) ----------
# Made by Gavin Crump
# Free for use
# BIM Guru, www.bimguru.com.au

# Boilerplate text
import clr

clr.AddReference('RevitAPI')
from Autodesk.Revit.DB import *
import Autodesk

clr.AddReference("RevitServices")
import RevitServices
from RevitServices.Persistence import DocumentManager

# Current document
doc = DocumentManager.Instance.CurrentDBDocument

bool = IN[0]

all_cats = Category.GetCategory(doc, BuiltInCategory.OST_Lines)
grap_cat = all_cats.GetGraphicsStyle(GraphicsStyleType.Projection)
styles   = grap_cat.GraphicsStyleCategory.SubCategories

allLineStyles = [s.GetGraphicsStyle(GraphicsStyleType.Projection) for s in styles]

Names = [UnwrapElement(p).Name for p in allLineStyles]

OUT = [allLineStyles, Names]
# ----------------------------------------
code_block = CodeBlock(out=python_script) { ele = out[0]; nam = out[1]; }
elements = Output(code_block.ele)  # The styles as elements
names = Output(code_block.nam)  # The names of the styles
