# Dynamo custom node ListCombinate.dyf "© ListCombinate" (Dynamo 2.3.1.11775)
# category: Crumple.List.Generate
# Given a list and a length, will find all combinations of that list included repetion of the elements. Takes order into consideration as well.

list = Input(list: var[]..[])
length = Input(length: int = 1)
python_script = Python(IN[0]=list, IN[1]=length)
# ---------- python_script.python (17 lines) ----------
# Made by Gavin Crump
# Free for use
# BIM Guru, www.bimguru.com.au

import itertools

combinations = []

data = IN[0]
length = IN[1]
cycled = data*length

for subset in itertools.permutations(cycled, length):
	if subset not in combinations:
		combinations.append(subset)
    
OUT = combinations
# ----------------------------------------
combinations = Output(python_script)
