# Dynamo custom node ListSplitAtIndex.dyf "© List.SplitAtIndex" (Dynamo 2.3.0.5885)
# category: Crumple.Data.Actions
# Splits a list at a specific index, then returns the two lists. You may need to use levels in order for this to work properly.

list = Input(list: var[]..[])
amount = Input(amount: var[]..[])
code_block = CodeBlock(l1=list, amt=amount) { DSCore.List.TakeItems(l1, amt); DSCore.List.DropItems(l1, amt); }
list1 = Output(code_block.out0)
list2 = Output(code_block.out1)
