# Dynamo custom node ListSplitAtValue.dyf "© List.SplitAtValue" (Dynamo 2.3.0.5885)
# category: Crumple.Data.Actions
# Given a list (or list of lists), split the lists into sublists wherever a specified value occurs. Typically used for processing lists of booleans or 1's and 0's in Ladybug sun hour results to isolate continuous periods.

elements = Input(elements: var[]..[])  # List or list of lists
splitter = Input(splitter: int = 0)  # Item to split at
python_script = Python(IN[0]=elements, IN[1]=splitter)
# ---------- python_script.python (33 lines) ----------
# Made by Gavin Crump
# Free for use
# BIM Guru, www.bimguru.com.au

# Define list function
def tolist(input):
    result = input if isinstance(input, list) else [input]
    return result

# Create a lazy iterator to break list at value
def splitter(seq, splitval = 0):
    # Add one instance of the splitter to the end
    seq.append(splitval)
    group = []
    # Iterate across all values
    for num in seq:
        if num != splitval:
            group.append(num)
        # If a splitval is found, yield to group
        elif group:
            yield group
            group = []

# Preparing input from dynamo to revit
values = tolist(IN[0])
result = []

# Iterate across all sublists
for n in values:
    result.append(list(splitter(n)))

# Preparing output to Dynamo
OUT = result
# ----------------------------------------
list = Output(python_script)  # The new lists.
