# Dynamo custom node MaterialsByPrefix.dyf "© MaterialsByPrefix" (Dynamo 2.3.0.5885)
# category: Crumple.Revit.Materials
# Returns all materials in the current document, sorted by whether they contain a specified prefix.

Prefix = Input(Prefix: string = "BG_")  # Prefix to check for
Refresh = Input(Refresh: bool = true)  # Toggle to refresh
python_script = Python(IN[0]=Prefix, IN[1]=Refresh)
# ---------- python_script.python (36 lines) ----------
# Made by Gavin Crump
# Free for use
# BIM Guru, www.bimguru.com.au

# Boilerplate text
import clr

clr.AddReference('RevitAPI')
from Autodesk.Revit.DB import *
import Autodesk

clr.AddReference("RevitServices")
import RevitServices
from RevitServices.Persistence import DocumentManager

# Current document
doc = DocumentManager.Instance.CurrentDBDocument

pref = IN[0]
bool = IN[1]

contains,namesc,doesnot,namesd = [],[],[],[]

collector = FilteredElementCollector(doc)
allMaterials = collector.OfClass(Material).ToElements()

for m in allMaterials:
	name = UnwrapElement(m.Name)
	if name.startswith(pref):
		contains.append(m)
		namesc.append(name)
	else:
		doesnot.append(m)
		namesd.append(name)

OUT = [contains, namesc, doesnot, namesd]
# ----------------------------------------
code_block = CodeBlock(out=python_script) { mat1 = out[0]; nam1 = out[1]; mat2 = out[2]; nam2 = out[3]; }
matches = Output(code_block.mat1)  # The matches as elements
theRest = Output(code_block.mat2)  # The non-matches as elements
matchNames = Output(code_block.nam1)  # The names of matches
theRestNames = Output(code_block.nam2)  # The names of non-matches
