# Dynamo custom node ParametersBipgByName.dyf "© Parameters.BIPGbyName" (Dynamo 2.3.0.5885)
# category: Crumple.Revit.Query
# Given a string or list of strings, return the corresponding BuiltIn Parameter Group.

names = Input(names: var[]..[])  # Names of parameter groups as strings
python_script = Python(IN[0]=names)
# ---------- python_script.python (30 lines) ----------
# Made by Gavin Crump
# Free for use
# BIM Guru, www.bimguru.com.au

# Boilerplate text
import clr
import System

clr.AddReference("RevitAPI")
import Autodesk 
from Autodesk.Revit.DB import *

# Declare inputs
names = IN[0] if isinstance(IN[0], list) else [IN[0]]

# Enumerate over all BIPG types
bi_groups = [a for a in System.Enum.GetValues(BuiltInParameterGroup)]
bi_names  = [a.ToString() for a in System.Enum.GetValues(BuiltInParameterGroup)]

matches = []

for n in names:
	try:
		ind = bi_names.index(n)
		matches.append(bi_groups[ind])
	except:
		matches.append(None)

# Preparing output to Dynamo
OUT = matches
# ----------------------------------------
groups = Output(python_script)  # The corresponding groups. No match = Null
