# Dynamo custom node PointsToRevitCoordinates.dyf (Dynamo 2.3.0.5885)
# category: Crumple.Revit.Coordinates
# This node translates points in Dynamo coordinates to their respective Revit project coordinate. The results may be converted as Metric format (mm) or Imperial (feet).

code_block = CodeBlock { xy = Plane.XY(); Plane.ToCoordinateSystem(xy); Autodesk.Point.Origin(); Vector.ZAxis(); }
Metric = Input(Metric: bool = true)
python_script = Python(IN[0]=Metric)
# ---------- python_script.python (54 lines) ----------
# Made by Gavin Crump
# Free for use
# BIM Guru, www.bimguru.com.au
# Credit to Genius Loci for much of the workflow

# Boilerplate text
import clr
import math

# Revit nodes
clr.AddReference("RevitNodes")
import Revit
clr.ImportExtensions(Revit.Elements)
clr.ImportExtensions(Revit.GeometryConversion)

# Revit services and API
clr.AddReference("RevitServices")
import RevitServices
from RevitServices.Persistence import DocumentManager 

clr.AddReference("RevitAPI")
import Autodesk 
from Autodesk.Revit.DB import *

# Current doc/app/ui
doc = DocumentManager.Instance.CurrentDBDocument

# Preparing input from dynamo to revit
metric = IN[0]

# Get project position
ori = doc.ActiveProjectLocation.GetProjectPosition(XYZ(0,0,0))

# Get project base point
pbps    = FilteredElementCollector(doc).OfCategory(BuiltInCategory.OST_ProjectBasePoint).ToElements()
pbp     = pbps[0]

# Get pbp angle
an = pbp.get_Parameter(BuiltInParameter.BASEPOINT_ANGLETON_PARAM).AsDouble()
pbp_an = round(an * 180/math.pi)

# Feet or mm converter
if metric == True:
	U_mult = -304.8
else:
	U_mult = -1

# Get translation values from origin
y = round(ori.NorthSouth * U_mult, 6)
x = round(ori.EastWest   * U_mult, 6)
z = round(ori.Elevation  * U_mult, 6)

# Preparing output to Dynamo
OUT = [pbp_an, x, y, z]
# ----------------------------------------
code_block_2 = CodeBlock(out=python_script) { a = out[0]; x = out[1]; y = out[2]; z = out[3]; }
rotate = CoordinateSystem.Rotate(coordinateSystem=code_block.out1, origin=code_block.out2, axis=code_block.out3, degrees=code_block_2.a)
origin = Point.Origin()
byCartesianCoordinates = Point.ByCartesianCoordinates(cs=rotate, x=code_block_2.x, y=code_block_2.y, z=code_block_2.z)
byTwoPoints = Vector.ByTwoPoints(start=origin, end=byCartesianCoordinates)
distanceTo = Geometry.DistanceTo(geometry=origin, other=byCartesianCoordinates)
translate = CoordinateSystem.Translate(coordinateSystem=rotate, direction=byTwoPoints, distance=distanceTo)
points_dyn = Input(points_dyn: var[]..[])
code_block_3 = CodeBlock(in_pts=points_dyn) { in_pts.X; in_pts.Y; in_pts.Z; }
byCartesianCoordinates_2 = Point.ByCartesianCoordinates(cs=translate, x=code_block_3.out0, y=code_block_3.out1, z=code_block_3.out2)
points_rvt = Output(byCartesianCoordinates_2)
