# Dynamo custom node PolyCurveGreatestArea.dyf "© Polycurve.GreatestArea" (Dynamo 2.12.1.8246)
# category: Crumple.Geometry.Actions
# From a list of polycurves, return the one with the largest area only. Can be useful for determining the outer-most boundary in a room with internalised holes.

polycurves = Input(polycurves: var[]..[])  # A list of polycurves.
byPatch = Surface.ByPatch(closedCurve=polycurves)
area = Surface.Area(surface=byPatch)
sortByKey = List.SortByKey(list=polycurves, keys=area)
code_block = CodeBlock(x=sortByKey.sortedList) { x[-1]; }
greatest = Output(code_block)  # The polycurve with the greatest enclosed area.
code_block_2 = CodeBlock { -1; }
dropItems = List.DropItems(list=sortByKey.sortedList, amount=code_block_2)
theRest = Output(dropItems)  # The remaining polycurves that were smaller.
