# Dynamo custom node PrimaryView.dyf "© PrimaryView" (Dynamo 2.3.1.11775)
# category: Crumple.Revit.Views
# For a dependent view, return it's primary view, as well as if it has one.

views = Input(views: var[]..[])
python_script = Python(IN[0]=views)
# ---------- python_script.python (38 lines) ----------
# Made by Gavin Crump
# Free for use
# BIM Guru, www.bimguru.com.au

# Boilerplate text
import clr

clr.AddReference("RevitServices")
import RevitServices
from RevitServices.Persistence import DocumentManager 

clr.AddReference("RevitAPI")
import Autodesk 
from Autodesk.Revit.DB import *

# Current doc
doc = DocumentManager.Instance.CurrentDBDocument

# Define list function
def uwlist(input):
    result = input if isinstance(input, list) else [input]
    return UnwrapElement(result)

# Preparing input from dynamo to revit
viewlist = uwlist(IN[0])
parentlist,hasparent = [],[]

# Find the parents
for v in viewlist:
	parent = Document.GetElement(doc, v.GetPrimaryViewId())
	parentlist.append(parent)
	if parent == None:
		hasparent.append(False)
	else:
		hasparent.append(True)

# Preparing output to Dynamo
OUT = [parentlist, hasparent]
# ----------------------------------------
code_block = CodeBlock(x=python_script) { x[0]; x[1]; }
primaryView = Output(code_block.out0)
hasPrimary = Output(code_block.out1)
