# Dynamo custom node ProjectBasePoint.dyf (Dynamo 2.3.0.5885)
# category: Crumple.Revit.Coordinates
# This node will return the Revit project base point as well as the NS, EW and elevation values. The result may be returned in Metric format (mm) or Imperial (feet).

Metric = Input(Metric: bool = true)
python_script = Python(IN[0]=Metric)
# ---------- python_script.python (56 lines) ----------
# Made by Gavin Crump
# Free for use
# BIM Guru, www.bimguru.com.au
# Credit to Genius Loci for much of the workflow

# Boilerplate text
import clr
import math

# Revit nodes
clr.AddReference("RevitNodes")
import Revit
clr.ImportExtensions(Revit.Elements)
clr.ImportExtensions(Revit.GeometryConversion)

# Revit services and API
clr.AddReference("RevitServices")
import RevitServices
from RevitServices.Persistence import DocumentManager 

clr.AddReference("RevitAPI")
import Autodesk 
from Autodesk.Revit.DB import *

# Current doc/app/ui
doc = DocumentManager.Instance.CurrentDBDocument

# Preparing input from dynamo to revit
metric = IN[0]

# Get project base point
pbps    = FilteredElementCollector(doc).OfCategory(BuiltInCategory.OST_ProjectBasePoint).ToElements()
pbp     = pbps[0]

# Feet or mm converter
if metric == True:
	U_mult = 304.8
else:
	U_mult = 1

points = []

# Get pbp values
ew = pbp.get_Parameter(BuiltInParameter.BASEPOINT_EASTWEST_PARAM).AsDouble()
ns = pbp.get_Parameter(BuiltInParameter.BASEPOINT_NORTHSOUTH_PARAM).AsDouble()
el = pbp.get_Parameter(BuiltInParameter.BASEPOINT_ELEVATION_PARAM).AsDouble()
an = pbp.get_Parameter(BuiltInParameter.BASEPOINT_ANGLETON_PARAM).AsDouble()

# Get EW, NS, Elev
pbp_ns = round(ns * U_mult, 6)
pbp_ew = round(ew * U_mult, 6)
pbp_el = round(el * U_mult, 6)
pbp_an = round(an * 180/math.pi)

# Preparing output to Dynamo
OUT = [pbp_ns, pbp_ew, pbp_el, pbp_an]
# ----------------------------------------
code_block = CodeBlock(x=python_script) { x[0]; x[1]; x[2]; x[3]; }
NS = Output(code_block.out0)
EW = Output(code_block.out1)
Elevation = Output(code_block.out2)
AngleToTN = Output(code_block.out3)
