# Dynamo custom node ProjectOrigin.dyf "© ProjectOrigin" (Dynamo 2.3.0.5885)
# category: Crumple.Revit.Coordinates
# This node will return the Revit project origin as well as the NS, EW and elevation values.

origin = Point.Origin()
Point = Output(origin)  # The Revit internal origin as a point in Dynamo.  NB: This is the Dynamo origin too!
Refresh = Input(Refresh: bool = true)  # Toggle to refresh
python_script = Python(IN[0]=Refresh)
# ---------- python_script.python (33 lines) ----------
# Made by Gavin Crump
# Free for use
# BIM Guru, www.bimguru.com.au

# Boilerplate text
import clr

# Revit services and API
clr.AddReference("RevitServices")
import RevitServices
from RevitServices.Persistence import DocumentManager 

clr.AddReference("RevitAPI")
import Autodesk 
from Autodesk.Revit.DB import *

# Current doc/app/ui
doc = DocumentManager.Instance.CurrentDBDocument

# Get project position
ori = doc.ActiveProjectLocation.GetProjectPosition(XYZ(0,0,0))

# Get unit types
DUT = Document.GetUnits(doc).GetFormatOptions(UnitType.UT_Length).DisplayUnits

# Get EW, NS, Elev
# Thanks for letting me know about the rounding issue Ruben Romero Vivancos!
ori_ns = round(UnitUtils.ConvertFromInternalUnits((ori.NorthSouth), DUT), 15)
ori_ew = round(UnitUtils.ConvertFromInternalUnits((ori.EastWest), DUT), 15)
ori_el = round(UnitUtils.ConvertFromInternalUnits((ori.Elevation), DUT), 15)

# Preparing output to Dynamo
OUT = [ori_ns, ori_ew, ori_el]
# ----------------------------------------
code_block = CodeBlock(x=python_script) { x[0]; x[1]; x[2]; }
NS = Output(code_block.out0)  # The Northing value of the internal origin returned in Revit coordinates.
EW = Output(code_block.out1)  # The Easting value of the internal origin returned in Revit coordinates.
Elevation = Output(code_block.out2)  # The elevation value of the internal origin returned in Revit coordinates.
