# Dynamo custom node RegionsEdgeStyles.dyf "© Regions.EdgeStyles" (Dynamo 2.12.1.8246)
# category: Crumple.Revit.Query
# Returns the graphic styles of the edges of a filled or masking region.

regions = Input(regions: var[]..[])
python_script = Python(IN[0]=regions)  # IronPython2
# ---------- python_script.python (51 lines) ----------
# Made by Gavin Crump
# Free for use
# BIM Guru, www.bimguru.com.au

# Boilerplate text
import clr

clr.AddReference("RevitServices")
import RevitServices
from RevitServices.Persistence import DocumentManager 

# Get app
uiapp = DocumentManager.Instance.CurrentUIApplication 
app = uiapp.Application 

# Define list/unwrap list functions
def uwlist(input):
    result = input if isinstance(input, list) else [input]
    return UnwrapElement(result)

def objOrList(input, initial = IN[0]):
	if isinstance(initial, list):
		return input
	else:
		return input[0]

# Document and regions
regions = uwlist(IN[0])

# Establish default options and prepare edge arrays
geomOption = app.Create.NewGeometryOptions()

lineStyles = []

# Construct edge array for review
for r in regions:
	
	geomElem = r.get_Geometry(geomOption)
	enum1 = geomElem.GetEnumerator() ; enum1.MoveNext()
	geo = enum1.Current
	edgeArray = geo.Edges
	
	ls = []
	
	for edge in edgeArray:
		ls.append(r.Document.GetElement(edge.GraphicsStyleId))
	
	lineStyles.append(ls)

# Preparing output to Dynamo
OUT = objOrList(lineStyles)
# ----------------------------------------
graphicStyles = Output(python_script)
