# Dynamo custom node ReplaceNulls.dyf "© ReplaceNulls" (Dynamo 2.3.0.5885)
# category: Crumple.List.Modify
# Replaces all nulls with a given substitute.

lst = Input(lst: var[]..[])  # Data to be modified.
isNull = Object.IsNull(obj=lst)
replace = Input(replace: var[]..[])  # What to replace nulls with.
if_ = If(test=isNull, true=replace, false=lst)
result = Output(if_)
