# Dynamo custom node RevitCurrentPath.dyf "© Revit.CurrentPath" (Dynamo 2.12.1.8246)
# category: Crumple.Application.Query
# Returns the full file path, directory path and name of a Revit document.
# packages: Crumple 2022.2.13

docOrLink = Input(docOrLink: var[]..[] = null)  # Uses current if none provided. Accepts document or link instance.
revit_getdocument = Custom[© Revit.GetDocument](docOrLink=docOrLink)  # package Crumple; If no input is specified or an invalid one is, returns current document. If a link instance is provided, it returns the linked document. If a document is provided it will pass it through.
python_script = Python(IN[0]=revit_getdocument.document)  # IronPython2
# ---------- python_script.python (17 lines) ----------
# Made by Gavin Crump
# Free for use
# BIM Guru, www.bimguru.com.au

# Boilerplate text
import clr

clr.AddReference("RevitAPI")
import Autodesk
from Autodesk.Revit.DB import Document

# Current doc and path
doc  = IN[0]
path = Document.PathName.GetValue(doc)

# Name and path
OUT = path,path.rsplit("\\",1)
# ----------------------------------------
code_block = CodeBlock(out=python_script) { out[0]; out[1][0]; out[1][1]; }
filePath = Output(code_block.out0)
directoryPath = Output(code_block.out1)
fileName = Output(code_block.out2)
