# Dynamo custom node RevitCurrentView.dyf "© Revit.CurrentView" (Dynamo 2.12.1.8246)
# category: Crumple.Application.Query
# Given the current document, return the active view.

refresh = Input(refresh: bool = true)
code_block = CodeBlock(x=refresh) { x; document1 = Revit.Document.Current; Revit.Document.ActiveView(document1); }
activeView = Output(code_block.out2)
