# Dynamo custom node RevitExportToPdf.dyf "© Revit.ExportPdf" (Dynamo 2.10.1.3976)
# category: Crumple.Application.Create
# Given a list of sheets, names, directory and export options this node will batch export PDF files. Requires Revit 2022 or higher to work.

sheets = Input(sheets: var[]..[])
names = Input(names: var[]..[])
directory = Input(directory: string)
options = Input(options: var[]..[] = [true, true, true, true, true])
python_script = Python(IN[0]=sheets, IN[1]=names, IN[2]=directory, IN[3]=options)  # IronPython2
# ---------- python_script.python (89 lines) ----------
# Made by Gavin Crump
# Credit to Sean Page for sharing these methods via the forums!
# https://forum.dynamobim.com/t/export-pdf-in-revit-2022-quick-example/62697
# Free for use
# BIM Guru, www.bimguru.com.au

# Boilerplate text
import clr

clr.AddReference('System')
from System.Collections.Generic import List

clr.AddReference("RevitNodes")
import Revit
clr.ImportExtensions(Revit.Elements)

clr.AddReference("RevitServices")
import RevitServices
from RevitServices.Persistence import DocumentManager 

clr.AddReference("RevitAPI")
import Autodesk
from Autodesk.Revit.DB import *

# Current doc/app/ui
doc = DocumentManager.Instance.CurrentDBDocument

# Define list/unwrap list functions
def tolist(input):
    result = input if isinstance(input, list) else [input]
    return result

def uwlist(input):
    result = input if isinstance(input, list) else [input]
    return UnwrapElement(input)

# Preparing input from dynamo to revit
sheets  = uwlist(IN[0])
names   = tolist(IN[1])
direc   = IN[2]
options = IN[3]

#Sean Page, 2021
import clr

clr.AddReference('RevitAPI')
from Autodesk.Revit.DB import *

clr.AddReference('RevitNodes')
import Revit
clr.ImportExtensions(Revit.Elements)

clr.AddReference('RevitServices')
import RevitServices
from RevitServices.Persistence import DocumentManager

# Current document
doc = DocumentManager.Instance.CurrentDBDocument

# Collect inputs and set containers
Sheets = UnwrapElement(IN[0])
Names = IN[1]
Folder = IN[2]
Options = IN[3]

result = []
sheets = List[ElementId]()

# Collect and set export options
opts = PDFExportOptions()

opts.HideCropBoundaries = Options[0]
opts.HideScopeBoxes = Options[1]
opts.HideReferencePlane = Options[2]
opts.HideUnreferencedViewTags = Options[3]
opts.MaskCoincidentLines = Options[4]

# This will uses the Sheet Size for Paper size, or default to Letter
opts.PaperFormat = ExportPaperFormat.Default

# Execute the batch export
for sheet,name in zip(Sheets,Names):
	opts.FileName = name
	Sheet = List[ElementId]()
	Sheet.Add(sheet.Id)
	result.append(doc.Export(Folder,Sheet,opts))

# Preparing output to Dynamo
OUT = result
# ----------------------------------------
didItExport = Output(python_script)
