# Dynamo custom node RevitGetDocuments.dyf "© Revit.GetDocuments" (Dynamo 2.12.1.8246)
# category: Crumple.Application.Query
# Returns the documents currently opened in the Revit application. The current document will be in a separate output to the background opened documents.

refresh = Input(refresh: bool = true)
python_script = Python(IN[0]=refresh)  # IronPython2
# ---------- python_script.python (27 lines) ----------
# Made by Gavin Crump
# Free for use
# BIM Guru, www.bimguru.com.au

# Boilerplate text
import clr

clr.AddReference("RevitServices")
import RevitServices
from RevitServices.Persistence import DocumentManager 

# Current doc/app/ui
doc = DocumentManager.Instance.CurrentDBDocument
uiapp = DocumentManager.Instance.CurrentUIApplication 
app = uiapp.Application 

# Get documents
documents = app.Documents

# Get current and other docs
otherDocs = []

for d in app.Documents:
	if d.Title != doc.Title:
		otherDocs.append(d)

OUT = [doc, otherDocs]
# ----------------------------------------
code_block = CodeBlock(X=python_script) { X[0]; X[1]; }
current = Output(code_block.out0)
background = Output(code_block.out1)
