# Dynamo custom node RevitImportCad.dyf "© Revit.ImportCAD" (Dynamo 2.12.1.8246)
# category: Crumple.Application.Create
# Attempts to import CAD files from file paths to nominated views.

filePaths = Input(filePaths: var[]..[])
importView = Input(importView: Revit.Elements.Views.View)  # View to aid placement
unitType = Input(unitType: string = "Millimeter")
python_script = Python(IN[0]=filePaths, IN[1]=importView, IN[2]=unitType)  # IronPython2
# ---------- python_script.python (85 lines) ----------
# Made by Gavin Crump
# Free for use
# BIM Guru, www.bimguru.com.au

# Boilerplate text
import clr
import System

clr.AddReference('RevitServices')
import RevitServices
from RevitServices.Persistence import DocumentManager
from RevitServices.Transactions import TransactionManager

clr.AddReference('RevitAPI')
import Autodesk
from Autodesk.Revit.DB import ImportUnit, DWGImportOptions, ImportColorMode, ElementId, Transaction

# Current doc
doc = DocumentManager.Instance.CurrentDBDocument

# Define list/unwrap list functions
def tolist(input):
    result = input if isinstance(input, list) else [input]
    return result

def uwlist(input):
    result = input if isinstance(input, list) else [input]
    return UnwrapElement(result)

# Get inputs
filePaths = tolist(IN[0])
views     = uwlist(IN[1])

# Get import unit types as enumeration
enums = System.Enum.GetValues(Autodesk.Revit.DB.ImportUnit)
names = [str(u) for u in enums]

# Find matching enum unit type
i = names.index(IN[2])
unitType = enums[i]

# CAD settings
customscale = False
colormode = "Preserve"
placement = "Origin"
allView = True

# Empty lists
results, importInstances = [],[],[],[]

# Import options
options = DWGImportOptions()
options.AutoCorrectAlmostVHLines = True
options.OrientToView = False
options.ThisViewOnly = False
options.VisibleLayersOnly = True
ImportColorMode.Preserved
options.Placement.Origin
options.Unit = unitType

# Create ElementId / .NET object


# Import CAD files
for fp in filePaths:
	# Try to import CAD
	try:
		# Create ElementId / .NET object
		linkedElem = clr.Reference[ElementId]()
		# Import CAD
		with Transaction(doc, 'Import CAD') as t:
			t.Start()
			doc.Import(fp, options, views, linkedElem)
			t.Commit()
		# Get import instance
		importInstance = doc.GetElement(linkedElem.Value)
		importInstances.append(importInstance)
		results.append(True)
	# Otherwise it failed
	except:
		importInstances.append(None)
		results.append(False)
	
# Outputs
OUT = importInstances, results
# ----------------------------------------
code_block = CodeBlock(x=python_script) { x[0]; x[1]; }
importInstances = Output(code_block.out0)
wasImported = Output(code_block.out1)
