# Dynamo custom node RevitIsWorkshared.dyf "© Revit.IsWorkshared" (Dynamo 2.3.1.11775)
# category: Crumple.Application.Query
# Returns if a document is workshared.
# packages: Crumple 2022.2.13

docOrLink = Input(docOrLink: var[]..[] = null)  # Uses current if none provided. Accepts document or link instance.
revit_getdocument = Custom[© Revit.GetDocument](docOrLink=docOrLink)  # package Crumple; If no input is specified or an invalid one is, returns current document. If a link instance is provided, it returns the linked document. If a document is provided it will pass it through.
python_script = Python(IN[0]=revit_getdocument.document)
# ---------- python_script.python (22 lines) ----------
# Made by Gavin Crump
# Free for use
# BIM Guru, www.bimguru.com.au
# Large in part borrows from Clockwork

# Boilerplate text
import clr

clr.AddReference("RevitServices")
import RevitServices
from RevitServices.Persistence import DocumentManager 

# Inputs
doc = IN[0]

if doc.IsWorkshared:
	ws = True
else:
	ws = False

# Preparing output to Dynamo
OUT = ws
# ----------------------------------------
workshared = Output(python_script)
