# Dynamo custom node RevitStartView.dyf "© Revit.StartView" (Dynamo 2.12.1.8246)
# category: Crumple.Application.Query
# Returns the start view of the document if there is one nominated.
# packages: Crumple 2022.5.27

docOrLink = Input(docOrLink: var[]..[] = null)  # Uses current if none provided. Accepts document or link instance.
revit_getdocument = Custom[© Revit.GetDocument](docOrLink=docOrLink)  # package Crumple; If no input is specified or an invalid one is, returns current document. If a link instance is provided, it returns the linked document. If a document is provided it will pass it through.
python_script = Python(IN[0]=revit_getdocument.document)  # IronPython2
# ---------- python_script.python (29 lines) ----------
# Made by Gavin Crump
# Free for use
# BIM Guru, www.bimguru.com.au

# Boilerplate text
import clr

clr.AddReference("RevitServices")
import RevitServices
from RevitServices.Persistence import DocumentManager 

clr.AddReference("RevitAPI")
import Autodesk 
from Autodesk.Revit.DB import *

# Current doc/app/ui
uiapp = DocumentManager.Instance.CurrentUIApplication 
uidoc = uiapp.ActiveUIDocument

# Preparing input from dynamo to revit
doc = IN[0]

# Get start view
try:
	startSettings = StartingViewSettings.GetStartingViewSettings(doc)
	startViewId = startSettings.ViewId
	OUT = doc.GetElement(startViewId)
except:
	OUT = None
# ----------------------------------------
view = Output(python_script)
