# Dynamo custom node RevitVersion.dyf "© Revit.Version" (Dynamo 2.3.1.11775)
# category: Crumple.Application.Query
# Returns the build information about the active Revit session.

refresh = Input(refresh: bool = true)
python_script = Python(IN[0]=refresh)
# ---------- python_script.python (30 lines) ----------
# Made by Gavin Crump
# Free for use
# BIM Guru, www.bimguru.com.au
# Mostly made from Clockwork, was a useful script so absorbed

# Boilerplate text
import clr

clr.AddReference("RevitServices")
import RevitServices
from RevitServices.Persistence import DocumentManager 

# Current doc/app
doc = DocumentManager.Instance.CurrentDBDocument
uiapp = DocumentManager.Instance.CurrentUIApplication 
app = uiapp.Application 

# Collect build data
if int(app.VersionNumber) > 2017:
	fullVersion = app.SubVersionNumber
else:
	fullVersion = str(app.VersionNumber)

versionName  = app.VersionName
versionBuild = app.VersionBuild
language = app.Language.ToString()
versionShort = int(app.VersionNumber)

# Preparing output to Dynamo
OUT = [versionName, versionShort, fullVersion, versionBuild, language]
# ----------------------------------------
code_block = CodeBlock(out=python_script) { out[0]; out[1]; out[2]; out[3]; out[4]; }
name = Output(code_block.out0)
version = Output(code_block.out1)
subVersion = Output(code_block.out2)
build = Output(code_block.out3)
language = Output(code_block.out4)
