# Dynamo custom node RoomsNameNumber.dyf "© Rooms.NameNumber" (Dynamo 2.12.1.8246)
# category: Crumple.Revit.Query
# Returns the names and numbers of rooms. Typically the name property of a room in the API returns name and number, so this node works around this.

room = Input(room: var[]..[])  # A room or list of rooms.
python_script = Python(IN[0]=room)  # IronPython2
# ---------- python_script.python (48 lines) ----------
# Made by Gavin Crump
# Free for use
# BIM Guru, www.bimguru.com.au

# Boilerplate text
import clr

clr.AddReference("RevitServices")
import RevitServices
from RevitServices.Persistence import DocumentManager 

clr.AddReference("RevitAPI")
import Autodesk 
from Autodesk.Revit.DB import *

# Current doc/app/ui
doc = DocumentManager.Instance.CurrentDBDocument
uiapp = DocumentManager.Instance.CurrentUIApplication 
app = uiapp.Application
ver = int(app.VersionNumber)
bip_roomName = BuiltInParameter.ROOM_NAME

# Define list/unwrap list functions
def uwlist(input):
    result = input if isinstance(input, list) else [input]
    return UnwrapElement(result)

def getBip(element, bip):
	# RVT < 2022
	if ver < 2022:
		return element.get_Parameter(bip)
	# RVT >= 2022
	else:
		id_forgeType = ParameterUtils.GetParameterTypeId(bip)
		return element.GetParameter(id_forgeType)

def getRoomName(room):
	try:
		bip = getBip(room, bip_roomName)
		return bip.AsString()
	except:
		return ""

# Preparing input from dynamo to revit
rooms = uwlist(IN[0])

# Preparing output to Dynamo
OUT = [[r.Number for r in rooms], [getRoomName(r) for r in rooms]]
# ----------------------------------------
code_block = CodeBlock(X=python_script) { X[0]; X[1]; }
numbers = Output(code_block.out0)
names = Output(code_block.out1)
