# Dynamo custom node RoundToString.dyf "© RoundToString" (Dynamo 2.3.0.5885)
# category: Crumple.String.Generate
# Given a list of numbers with decimal places, round them to a specific length and convert that to a string. More reliable than String.ToObject.

numbers = Input(numbers: var[]..[])  # Data for conversion.
digits = Input(digits: int = 2)  # Rounding digits.
python_script = Python(IN[0]=numbers, IN[1]=digits)
# ---------- python_script.python (21 lines) ----------
# Made by Gavin Crump
# Free for use
# BIM Guru, www.bimguru.com.au

# Get inputs
items = IN[0] if isinstance(IN[0], list) else [IN[0]]
n = IN[1]

# Convert to strings
strings = []

for i in items:
	tostr = str(i)
	try:
		ind = tostr.index(".")+n+1
		strings.append(tostr[:ind])
	except:
		strings.append(tostr)

# Define outputs
OUT = strings
# ----------------------------------------
str = Output(python_script)  # Data returned as strings.
