# Dynamo custom node SchedulesRenameHeaders.dyf "© Schedules.RenameHeaders" (Dynamo 2.12.1.8246)
# category: Crumple.Revit.Create
# Given a schedule as well as lists of existing/new naming targets, the node will attempt to find a header with that matching name and update its name to the new one.

schedule = Input(schedule: var[]..[])
namesCurrent = Input(namesCurrent: var[]..[])
namesNew = Input(namesNew: var[]..[])
python_script = Python(IN[0]=schedule, IN[1]=namesCurrent, IN[2]=namesNew)  # IronPython2
# ---------- python_script.python (62 lines) ----------
# Made by Gavin Crump
# Free for use
# BIM Guru, www.bimguru.com.au

# Boilerplate text
import clr

clr.AddReference("RevitNodes")
import Revit
clr.ImportExtensions(Revit.Elements)

clr.AddReference("RevitServices")
import RevitServices
from RevitServices.Persistence import DocumentManager
from RevitServices.Transactions import TransactionManager

# Current doc/app/ui
doc = DocumentManager.Instance.CurrentDBDocument

# Define list/unwrap list functions
def tolist(input):
    result = input if isinstance(input, list) else [input]
    return result

# Preparing input from dynamo to revit
sched       = UnwrapElement(IN[0])
definition  = sched.Definition
count_field = definition.GetFieldCount()

names_old = tolist(IN[1])
names_new = tolist(IN[2])

fields, fieldnames, fieldmatch, results = [],[],[],[],[]

# Get all fields and their column headings
for i in range(0, count_field, 1):
	field = definition.GetField(i)
	name  = field.ColumnHeading
	fields.append(field)
	fieldnames.append(name)
	
# Find the matching fields for the existing names
for n in names_old:
	if n in fieldnames:
		ind = fieldnames.index(n)
		fieldmatch.append(fields[ind])
	else:
		fieldmatch.append(None)

# Do some action in a Transaction
TransactionManager.Instance.EnsureInTransaction(doc)

for f, n in zip(fieldmatch, names_new):
	if f:
		f.ColumnHeading = n
	else:
		pass

TransactionManager.Instance.TransactionTaskDone()

# Preparing output to Dynamo
OUT = [f != None for f in fieldmatch]
# ----------------------------------------
wasRenamed = Output(python_script)
