# Dynamo custom node ScopeBoxUsed.dyf "© ScopeBoxUsed" (Dynamo 2.3.1.11775)
# category: Crumple.Revit.ScopeBoxes
# Checks if a scope box is applied to any views, levels or grids in the current document.

scopeBoxes = Input(scopeBoxes: var[]..[])
python_script = Python(IN[0]=scopeBoxes)
# ---------- python_script.python (44 lines) ----------
# Made by Gavin Crump
# Free for use
# BIM Guru, www.bimguru.com.au

# Boilerplate text
import clr

clr.AddReference("RevitAPI")
import Autodesk
from Autodesk.Revit.DB import *

clr.AddReference("RevitServices")
import RevitServices
from RevitServices.Persistence import DocumentManager

# Current doc/app/ui
doc = DocumentManager.Instance.CurrentDBDocument

# Get scope boxes
usedScopeBoxes, inUse = [],[]
    
# Check scopebox of elements
def checkSB(elements):
	for e in elements:
		try:
			if e.GetParameters("Scope Box")[0].AsValueString() != "None":
				usedScopeBoxes.append(e.GetParameters("Scope Box")[0].AsValueString())
		except:
			pass

# Get all used scopebox names
grids = FilteredElementCollector(doc).OfCategory(BuiltInCategory.OST_Grids).OfClass(Grid)
levels = FilteredElementCollector(doc).OfCategory(BuiltInCategory.OST_Levels).OfClass(Level)
views = FilteredElementCollector(doc).OfCategory(BuiltInCategory.OST_Views)

checkSB(grids)
checkSB(levels)
checkSB(views)

# Get all scope boxes in model
allScopeBoxes = IN[0]

# Preparing output to Dynamo
OUT = [s.Name in usedScopeBoxes for s in allScopeBoxes]
# ----------------------------------------
inUse = Output(python_script)
