# Dynamo custom node ScopeBoxViews.dyf "© ScopeBoxViews" (Dynamo 2.3.1.11775)
# category: Crumple.Revit.ScopeBoxes
# For a scope box or list of them, returns all views that are using that scope box.

scopeBoxes = Input(scopeBoxes: var[]..[])
python_script = Python(IN[0]=scopeBoxes)
# ---------- python_script.python (50 lines) ----------
# Made by Gavin Crump
# Free for use
# BIM Guru, www.bimguru.com.au

# Boilerplate text
import clr

clr.AddReference("RevitAPI")
import Autodesk
from Autodesk.Revit.DB import *

clr.AddReference("RevitServices")
import RevitServices
from RevitServices.Persistence import DocumentManager

# Current doc/app/ui
doc = DocumentManager.Instance.CurrentDBDocument

# Define list/unwrap list functions
def uwlist(input):
    result = input if isinstance(input, list) else [input]
    return UnwrapElement(result)

# Get scope boxes
sbs = uwlist(IN[0])
viewboxes,withboxes,finallist = [],[],[]

# Check all scope boxes of views
views = FilteredElementCollector(doc).OfCategory(BuiltInCategory.OST_Views)

for v in views:
	try:
		sbname = v.GetParameters("Scope Box")[0].AsValueString()
		if sbname != "None":
			viewboxes.append(sbname)
			withboxes.append(v)
	except:
		pass

# Check which views use each scope box
for s in sbs:
	viewset = []
	sbname2 = s.Name
	for v,w in zip(viewboxes,withboxes):
		if sbname2 == v:
			viewset.append(w)
	finallist.append(viewset)

# Preparing output to Dynamo
OUT = finallist
# ----------------------------------------
views = Output(python_script)
