# Dynamo custom node ScopeBoxesUsed.dyf "© ScopeBoxes.Used" (Dynamo 2.12.1.8246)
# category: Crumple.Revit.Query
# Checks if a scope box is applied to any views, levels or grids in a document.
# packages: Crumple 2022.2.13

scopeBoxes = Input(scopeBoxes: var[]..[])
docOrLink = Input(docOrLink: var[]..[] = null)  # Uses current if none provided. Accepts document or link instance.
revit_getdocument = Custom[© Revit.GetDocument](docOrLink=docOrLink)  # package Crumple; If no input is specified or an invalid one is, returns current document. If a link instance is provided, it returns the linked document. If a document is provided it will pass it through.
python_script = Python(IN[0]=scopeBoxes, IN[1]=revit_getdocument.document)  # IronPython2
# ---------- python_script.python (52 lines) ----------
# Made by Gavin Crump
# Free for use
# BIM Guru, www.bimguru.com.au

# Boilerplate text
import clr

clr.AddReference("RevitAPI")
import Autodesk
from Autodesk.Revit.DB import FilteredElementCollector, BuiltInCategory

# Define list/unwrap list functions
def uwlist(input):
    result = input if isinstance(input, list) else [input]
    return UnwrapElement(result)

def objOrList(input):
    if isinstance(input, list) and len(input) == 1:
        return input[0]
    else:
        return input

# Inputs from Dynamo
doc = IN[1]
checkScopeBoxes = uwlist(IN[0])

# Get scope boxes
usedNames = []
    
# Check scopebox of elements
def checkSB(elements):
	for e in elements:
		try:
			sbName = e.GetParameters("Scope Box")[0].AsValueString()
			if sbName != "None" and sbName not in usedNames:
				usedScopeBoxes.append(sbName)
		except:
			pass

# Get all used scopebox names
grids  = FilteredElementCollector(doc).OfCategory(BuiltInCategory.OST_Grids).OfClass(Grid)
levels = FilteredElementCollector(doc).OfCategory(BuiltInCategory.OST_Levels).OfClass(Level)
views  = FilteredElementCollector(doc).OfCategory(BuiltInCategory.OST_Views)

# Build list of scope box names in use
checkSB(grids)
checkSB(levels)
checkSB(views)

# Preparing output to Dynamo
checkBools = [s.Name in usedScopeBoxes for s in checkScopeBoxes]
OUT = objOrList(checkBools)
# ----------------------------------------
inUse = Output(python_script)
