# Dynamo custom node SharedParametersFlat.dyf "© SharedParameters.Flat" (Dynamo 2.12.1.8246)
# category: Crumple.Revit.Query
# Returns all shared parameters as definition and name, as well as their corresponding group and name.

refresh = Input(refresh: bool = true)  # Toggle to refresh
python_script = Python(IN[0]=refresh)  # IronPython2
# ---------- python_script.python (30 lines) ----------
# Made by Gavin Crump
# Free for use
# BIM Guru, www.bimguru.com.au

# Boilerplate text
import clr

clr.AddReference("RevitServices")
import RevitServices
from RevitServices.Persistence import DocumentManager

# Current doc/app/ui
uiapp = DocumentManager.Instance.CurrentUIApplication 
app = uiapp.Application 

defObjs, defNames, grpObjs, grpNames = [],[],[],[]

file = app.OpenSharedParameterFile()

groups = file.Groups

for group in groups:
	for d in group.Definitions:
		defObjs.append(d)
		defNames.append(d.Name)
		grpObjs.append(group)
		grpNames.append(group.Name)

# Preparing output to Dynamo
OUT = defObjs, defNames, grpObjs, grpNames
# ----------------------------------------
code_block = CodeBlock(out=python_script) { out[0]; out[1]; out[2]; out[3]; }
paramDefs = Output(code_block.out0)  # The parameter definitions
paramNames = Output(code_block.out1)  # The names of the parameters
groupDefs = Output(code_block.out2)  # The group definitions
groupNames = Output(code_block.out3)  # The names of the parameter groups
