# Dynamo custom node SharedParametersPath.dyf "© SharedParameters.Path" (Dynamo 2.12.1.8246)
# category: Crumple.Revit.Query
# Returns the path to the currently active shared parameters file.

refresh = Input(refresh: bool = true)  # Toggle to refresh
python_script = Python(IN[0]=refresh)  # IronPython2
# ---------- python_script.python (17 lines) ----------
# Made by Gavin Crump
# Free for use
# BIM Guru, www.bimguru.com.au

# Boilerplate text
import clr

clr.AddReference("RevitServices")
import RevitServices
from RevitServices.Persistence import DocumentManager 

# Current doc/app/ui
uiapp = DocumentManager.Instance.CurrentUIApplication 
app = uiapp.Application 

# Preparing output to Dynamo
OUT = app.SharedParametersFilename
# ----------------------------------------
filepath = Output(python_script)  # The path to the SP file.
