# Dynamo custom node SheetRevisions.dyf "© SheetRevisions" (Dynamo 2.3.0.5885)
# category: Crumple.Revit.Sheets
# Given a sheet, returns all revisions associated with that sheet as elements.

sheets = Input(sheets: var[]..[])
python_script = Python(IN[0]=sheets)
# ---------- python_script.python (35 lines) ----------
# Made by Gavin Crump
# Free for use
# BIM Guru, www.bimguru.com.au

# Boilerplate text
import clr

clr.AddReference("RevitServices")
import RevitServices
from RevitServices.Persistence import DocumentManager 

clr.AddReference("RevitAPI")
import Autodesk 
from Autodesk.Revit.DB import *

# Current doc/app/ui
doc = DocumentManager.Instance.CurrentDBDocument

# Define list/unwrap list functions
def uwlist(input):
    result = input if isinstance(input, list) else [input]
    return UnwrapElement(result)

# Preparing input from dynamo to revit
sheet_list = uwlist(IN[0])
sheet_revs = []

# Get revisions per sheet
for s in sheet_list:
	ids = s.GetAdditionalRevisionIds()
	revs = [doc.GetElement(r) for r in ids]
	sheet_revs.append(revs)

# Preparing output to Dynamo
OUT = sheet_revs
# ----------------------------------------
revisions = Output(python_script)
