# Dynamo custom node SheetTitleblock.dyf "© SheetTitleblock" (Dynamo 2.3.0.5885)
# category: Crumple.Revit.Sheets
# Given a sheet or list of sheets, return any titleblocks on that sheet as well as whether the sheet has titleblocks as a boolean.

sheets = Input(sheets: var[]..[])
python_script = Python(IN[0]=sheets)
# ---------- python_script.python (53 lines) ----------
# Made by Gavin Crump
# Free for use
# BIM Guru, www.bimguru.com.au

# Boilerplate text
import clr

clr.AddReference("RevitServices")
import RevitServices
from RevitServices.Persistence import DocumentManager 

clr.AddReference("RevitAPI")
import Autodesk 
from Autodesk.Revit.DB import *

# Current doc/app/ui
doc = DocumentManager.Instance.CurrentDBDocument

# Define list/unwrap list functions
def tolist(input):
    result = input if isinstance(input, list) else [input]
    return result

# Preparing input from dynamo to revit
sheet_list = tolist(IN[0])
sheet_ttbs, has_ttbs = [], []

# Collect all titleblocks in the project
tblocks = FilteredElementCollector(doc).OfCategory(BuiltInCategory.OST_TitleBlocks).ToElements()

# Get ttbs on sheets
for s in sheet_list:
	
	ttbs = []
	sid = s.Id
	
	# For each ttb check if it is on this sheet
	for tb in tblocks:
		if tb.OwnerViewId.IntegerValue == sid:
			ttbs.append(tb)
		else:
			continue
	
	sheet_ttbs.append(ttbs)
	
	# Check if there is at least 1 TTB
	if len(ttbs) > 0:
		has_ttbs.append(True)
	else:
		has_ttbs.append(False)

# Preparing output to Dynamo
OUT = [sheet_ttbs, has_ttbs]
# ----------------------------------------
code_block = CodeBlock(out=python_script) { ttbs = out[0]; has  = out[1]; }
titleBlocks = Output(code_block.ttbs)
hasTtb = Output(code_block.has)
