# Dynamo custom node SheetsCreate.dyf "© SheetsCreate" (Dynamo 2.3.0.5885)
# category: Crumple.Revit.Sheets
# Creates Revit sheets based on a list of names, numbers and a single Titleblock type.

ttb_type = Input(ttb_type: Revit.Elements.FamilyType)  # Titleblock as a family type. Note this node only applies one type to all sheets currently.
names = Input(names: var[]..[])  # Sheet names (strings).
numbers = Input(numbers: var[]..[])  # Sheet numbers (strings).
python_script = Python(IN[0]=ttb_type, IN[1]=names, IN[2]=numbers)
# ---------- python_script.python (73 lines) ----------
# Made by Gavin Crump
# Free for use
# BIM Guru, www.bimguru.com.au

# Credit for node concept to Julien Benoit @jbenoit44
# Original node from SteamNodes 1.2.4
# http://aecuandme.wordpress.com/

# I decided to clean up this node as I use it often and it doesn't
# work in Dynamo 2.3 or Revit 2020 anymore.

# Credits for Traceback:
# Copyright(c) 2015, Konrad K Sobon
# @arch_laboratory, http://archi-lab.net

# Boilerplate text
import clr

clr.AddReference("RevitNodes")
import Revit
clr.ImportExtensions(Revit.Elements)
clr.ImportExtensions(Revit.GeometryConversion)

clr.AddReference("RevitServices")
import RevitServices
from RevitServices.Persistence import DocumentManager 
from RevitServices.Transactions import TransactionManager 

clr.AddReference("RevitAPI")

import Autodesk 
from Autodesk.Revit.DB import *

# Current doc/app/ui
doc = DocumentManager.Instance.CurrentDBDocument

# Preparing input from dynamo to revit
ttb_d   = IN[0]
nam_d = IN[1] if isinstance(IN[1], list) else [IN[1]]
num_d = IN[2] if isinstance(IN[2], list) else [IN[2]]

# Unwrapping titleblock
ttb_r = UnwrapElement(ttb_d).Id

# Preparing empty lists
nam_r, num_r, sht_d = [], [], []

# Building name and number lists
[nam_r.append(n) for n in nam_d]
[num_r.append(n) for n in num_d]

# Do some action in a Transaction
TransactionManager.Instance.EnsureInTransaction(doc)
for na,nu in zip(nam_r,num_r):
	try:
		errorReport = None
		sht = ViewSheet.Create(doc,ttb_r)
		sht.Name = na
		sht.SheetNumber = nu
		sht_d.append(sht.ToDSType(False))
	except:
		# if error accurs anywhere in the process catch it
		import traceback
		errorReport = traceback.format_exc()

# your actions
TransactionManager.Instance.TransactionTaskDone()

# Preparing output to Dynamo
if errorReport == None:
	OUT = [sht_d, "No Errors"]
else:
	OUT = [sht_d, [errorReport]]
# ----------------------------------------
code_block = CodeBlock(x=python_script) { shts = x[0]; erep = x[1]; }
sheets = Output(code_block.shts)  # Sheets successfully created.
errors = Output(code_block.erep)  # Errors (unsuccessful sheets).
