# Dynamo custom node SheetsGetByNumber.dyf "© Sheets.GetByNumber" (Dynamo 2.3.1.11775)
# category: Crumple.Revit.Actions
# Given a sheet number, return the matching sheet. If no match is found, a message is returned. The node also returns a matches list and a list of indices for non-matches.
# packages: Crumple 2022.2.13

numbers = Input(numbers: var[]..[])  # Sheet numbers as strings.
docOrLink = Input(docOrLink: var[]..[] = null)  # Uses current if none provided. Accepts document or link instance.
revit_getdocument = Custom[© Revit.GetDocument](docOrLink=docOrLink)  # package Crumple; If no input is specified or an invalid one is, returns current document. If a link instance is provided, it returns the linked document. If a document is provided it will pass it through.
python_script = Python(IN[0]=numbers, IN[1]=revit_getdocument.document)
# ---------- python_script.python (42 lines) ----------
# Made by Gavin Crump
# Free for use
# BIM Guru, www.bimguru.com.au

# Boilerplate text
import clr 

# Revit API
clr.AddReference("RevitAPI")
import Autodesk 
from Autodesk.Revit.DB import *

# Current doc
doc = IN[1]

# Inputs, make sure it's a list
numbers = IN[0] if isinstance(IN[0], list) else [IN[0]]

# Container lists for iteration
sht_l, num_l, matches, matches_clean, fails = [], [], [], [], []

# Get all sheets and their numbers
sheets = FilteredElementCollector(doc).OfClass(Autodesk.Revit.DB.ViewSheet).ToElements()

for s in sheets:
	sht_l.append(s)
	num_l.append(s.SheetNumber)

# Find matching sheets, catch the non-matches
for n in numbers:
	try:
		ind = num_l.index(n)
		match = sht_l[ind]
		matches.append(match)
		matches_clean.append(match)
	except:
		ind = numbers.index(n)
		matches.append("No match")
		fails.append(ind)

# Preparing output to Dynamo
OUT = [matches, matches_clean, fails]
# ----------------------------------------
code_block = CodeBlock(x=python_script) { x[0]; x[1]; x[2]; }
sheets = Output(code_block.out0)  # All results, including the failing sheets.
matches_only = Output(code_block.out1)  # Successful results only.
failing_indices = Output(code_block.out2)  # These can be used to filter out the failing results. Feed in these to a 'get item at index' over another list.
