# Dynamo custom node SheetsGetRevisionNumbers.dyf "© Sheets.GetRevisionNumbers" (Dynamo 2.12.1.8246)
# category: Crumple.Revit.Query
# For a list of sheets and revisions, returns the numbers of those revisions on the sheets.

sheets = Input(sheets: var[]..[])
revisions = Input(revisions: var[]..[])
noRevString = Input(noRevString: string = "")
python_script = Python(IN[0]=sheets, IN[1]=revisions, IN[2]=noRevString)  # IronPython2
# ---------- python_script.python (40 lines) ----------
# Made by Gavin Crump
# Free for use
# BIM Guru, www.bimguru.com.au

# Boilerplate text
import clr

# Define list/unwrap list functions
def uwlist(input):
    result = input if isinstance(input, list) else [input]
    return UnwrapElement(result)

# Preparing input from dynamo to revit
sheets    = uwlist(IN[0])
revisions = uwlist(IN[1])
noRev     = IN[2]

# Revision Ids
revIds = [r.Id for r in revisions]
report = []

# For each sheet...
for s in sheets:
	# Empty row
	row = []
	# For each revision Id
	for r in revIds:
		# Get number on sheet
		numOnSht = s.GetRevisionNumberOnSheet(r)
		# If it has one, append
		if numOnSht:
			row.append(numOnSht)
		# If not append no rev
		else:
			row.append(noRev)
	# Append row
	report.append(row)

# Preparing output to Dynamo
OUT = report
# ----------------------------------------
numbersOnSheets = Output(python_script)
