# Dynamo custom node SheetsIsPlaceholder.dyf "© Sheets.IsPlaceholder" (Dynamo 2.12.1.8246)
# category: Crumple.Revit.Query
# Given a list of sheets, returns a boolean as to whether they are placeholders.

sheets = Input(sheets: var[]..[])
python_script = Python(IN[0]=sheets)  # IronPython2
# ---------- python_script.python (23 lines) ----------
# Made by Gavin Crump
# Free for use
# BIM Guru, www.bimguru.com.au

# Boilerplate text
import clr

# Define list/unwrap list functions
def uwlist(input):
    result = input if isinstance(input, list) else [input]
    return UnwrapElement(result)

def objOrList(input, initial = IN[0]):
	if isinstance(initial, list):
		return input
	else:
		return input[0]

# Preparing input from dynamo to revit
sheets = uwlist(IN[0])

# Preparing output to Dynamo
OUT = objOrList([s.IsPlaceholder for s in sheets])
# ----------------------------------------
isPlaceholder = Output(python_script)
