# Dynamo custom node SheetsNameFormatted.dyf "© Sheets.NameFormatted" (Dynamo 2.12.1.8246)
# category: Crumple.Revit.Actions
# Given a list of sheets, apply a typical naming convention to them with some optional fields such as prefix and separator.
# packages: Crumple 2024.3.1

sheets = Input(sheets: var[]..[])
includePrjNum = Input(includePrjNum: bool = true)
includeRevision = Input(includeRevision: bool = true)
includeName = Input(includeName: bool = true)
docOrLink = Input(docOrLink: var[]..[] = null)  # Uses current if none provided. Accepts document or link instance.
revit_getdocument = Custom[© Revit.GetDocument](docOrLink=docOrLink)  # package Crumple; If no input is specified or an invalid one is, returns current document. If a link instance is provided, it returns the linked document. If a document is provided it will pass it through.
python_script = Python(IN[0]=sheets, IN[1]=includePrjNum, IN[2]=includeRevision, IN[3]=includeName, IN[4]=revit_getdocument.document)  # IronPython2
# ---------- python_script.python (49 lines) ----------
# Made by Gavin Crump
# Free for use
# BIM Guru, www.bimguru.com.au

# Boilerplate text
import clr

clr.AddReference("RevitAPI")
import Autodesk 
from Autodesk.Revit.DB import FilteredElementCollector, ProjectInfo, ElementId

# Define list/unwrap list functions
def uwlist(input):
    result = input if isinstance(input, list) else [input]
    return UnwrapElement(result)

# Preparing input from dynamo to revit
sheets      = uwlist(IN[0])
includePrj  = IN[1]
includeRev  = IN[2]
includeName = IN[3]
doc         = IN[4]

invalidId   = ElementId.InvalidElementId

# Project information
projectInfo = FilteredElementCollector(doc).OfClass(ProjectInfo).FirstElement()
projectNumber = projectInfo.Number

# Make sheet names
sheetNames = []

for s in sheets:
	sn = s.SheetNumber
	if includePrj:
		sn = '{}-{}'.format(projectNumber, sn)
	if includeRev:
		revId = s.GetCurrentRevision()
		if revId != invalidId:
			revStr = s.GetRevisionNumberOnSheet(revId)
		else:
			revStr = "-"
		sn = '{} [{}]'.format(sn, revStr)
	if includeName:
		sn = '{} - {}'.format(sn, s.Name)
	sheetNames.append(sn)

# Preparing output to Dynamo
OUT = sheets, sheetNames
# ----------------------------------------
code_block = CodeBlock(x=python_script) { x[0]; x[1]; }
sheets_2 = Output(code_block.out0)  # "sheets"
sheetName = Output(code_block.out1)
