# Dynamo custom node SheetsTitleblock.dyf "© Sheets.Titleblock" (Dynamo 2.16.2.5624)
# category: Crumple.Revit.Actions
# Given a sheet or list of sheets, return any titleblocks on that sheet as well as whether the sheet has titleblocks as a boolean.

sheets = Input(sheets: var[]..[])
python_script = Python(IN[0]=sheets)  # CPython3
# ---------- python_script.python (40 lines) ----------
# Made by Gavin Crump
# Free for use
# BIM Guru, www.bimguru.com.au

# Boilerplate text
import clr

clr.AddReference("RevitAPI")
import Autodesk 
from Autodesk.Revit.DB import ElementCategoryFilter, BuiltInCategory

# Define list/unwrap list functions
def uwlist(input):
	result = input if isinstance(input, list) else [input]
	return UnwrapElement(result)

def objOrList(input, initial = IN[0]):
	if isinstance(initial, list):
		return input
	else:
		return input[0]

# Preparing input from dynamo to revit
sheet_list = uwlist(IN[0])

# Get ttbs on sheets
ttbs_out = []

categoryFilter = ElementCategoryFilter(BuiltInCategory.OST_TitleBlocks)

for s in sheet_list:
	dependentElements = s.GetDependentElements(categoryFilter)
	if len(dependentElements) > 0:
	   ttbs_out.append(s.Document.GetElement(dependentElements[0]))
	else:
	   ttbs_out.append(None)


# Preparing output to Dynamo
OUT = objOrList(ttbs_out)
# ----------------------------------------
titleBlocks = Output(python_script)
