# Dynamo custom node StringCaseSplit.dyf "© String.CaseSplit" (Dynamo 2.16.2.5624)
# category: Crumple.Data.Create
# Splits one or multiple strings into sublists, broken down at each upper case character.

str = Input(str: var[]..[])  # Strings for splitting
python_script = Python(IN[0]=str)  # CPython3
# ---------- python_script.python (30 lines) ----------
# Made by Gavin Crump
# Free for use
# BIM Guru, www.bimguru.com.au

#Import Regex (regular expressions)
import re

# Define list/unwrap list functions
def tolist(input):
    result = input if isinstance(input, list) else [input]
    return result

def objOrList(input, initial = IN[0]):
	if isinstance(initial, list):
		return input
	else:
		return input[0]

#Turn data into a list for iteration
lst = tolist(IN[0])

#Empty list, apply regex for capital letters
dataout = []

for str in lst:
	caps = re.findall('[A-Z][^A-Z]*', str)
	dataout.append(caps)

#Define output
OUT = objOrList(dataout)
# ----------------------------------------
strings = Output(python_script)  # Lists of sub-strings, grouped per owning string.
