# Dynamo custom node StringExplode.dyf "© StringExplode" (Dynamo 2.3.0.5885)
# category: Crumple.String.Modify
# Deconstructs a string (or list of strings) into their characters. There is the option to replace spaces with a special character which can be helpful for delimiting or visual ergonomics.

strings = Input(strings: var[]..[])  # Strings for exploding.
Sub = Input(Sub: string = " ")  # Optional replacement for spaces once exploded.
python_script = Python(IN[0]=strings, IN[1]=Sub)
# ---------- python_script.python (30 lines) ----------
# Made by Gavin Crump
# Free for use
# BIM Guru, www.bimguru.com.au
# Similar to Clockwork, but also allows sub of spaces
# I often found this was my next step to exploding strings

#Declare Input
data = IN[0]
sub = IN[1]

#If strings are not a list, make them a list
if isinstance(data, list):
	strlist = data
else:
	strlist = [data]

final = []

#Iterate upon the strings, then iterate their characters
for str in strlist:
	chars = []
	for char in str:
		if char == " ":
			chars.append(sub)
		else:
			chars.append(char)
	final.append(chars)

#Declare Output
OUT = final
# ----------------------------------------
Output = Output(python_script)  # Sublists of the exploded characters per string.
