# Dynamo custom node StringFromObject.dyf "© String.FromObject" (Dynamo 2.12.1.8246)
# category: Crumple.Data.Create
# Uses the python str() function to convert data types to strings. Unlike 'string from object' this will trim trailing 0's from numbers.

obj = Input(obj: var[]..[])  # Data for conversion.
python_script = Python(IN[0]=obj)  # IronPython2
# ---------- python_script.python (32 lines) ----------
# Made by Gavin Crump
# Free for use
# BIM Guru, www.bimguru.com.au

# Define list/unwrap list functions
def tolist(input):
    result = input if isinstance(input, list) else [input]
    return result

def objOrList(input, initial = IN[0]):
	if isinstance(initial, list):
		return input
	else:
		return input[0]

def toString(obj):
	obj = str(obj)
	if obj[-1] == "0" or obj[-1] == ".":
		try:
			newObj = obj.rstrip('0').rstrip('.')
			numObj = float(newObj)
			return newObj
		except:
			return obj
	else:
		return obj

# Get inputs
objects = tolist(IN[0])

# Define outputs
OUT = objOrList([toString(o) for o in objects])
# ----------------------------------------
str = Output(python_script)  # Data returned as strings.
