# Dynamo custom node StringRevitLegal.dyf "© String.RevitLegal" (Dynamo 2.3.1.11775)
# category: Crumple.Data.Actions
# Finds all illegal characters for a Revit named element and substitutes them with a character.

strings = Input(strings: var[]..[])
replacement = Input(replacement: string = "")
python_script = Python(IN[0]=strings, IN[1]=replacement)
# ---------- python_script.python (33 lines) ----------
def tolist(input):
    result = input if isinstance(input, list) else [input]
    return result

strings = tolist(IN[0])
replace = IN[1]
strlist,changed = [],[]

for str in strings:
	
	original = str + ""
	
	str = str.replace('\\', replace)
	str = str.replace(':', replace)
	str = str.replace('{', replace)
	str = str.replace('}', replace)
	str = str.replace('[', replace)
	str = str.replace(']', replace)
	str = str.replace('|', replace)
	str = str.replace(';', replace)
	str = str.replace('<', replace)
	str = str.replace('>', replace)
	str = str.replace('?', replace)
	str = str.replace('`', replace)
	str = str.replace('~', replace)
	strlist.append(str)
	
	if original == str:
		changed.append(False)
	else:
		changed.append(True)

OUT = [strlist, changed]
# ----------------------------------------
code_block = CodeBlock(data=python_script) { data[0]; data[1]; }
changed = Output(code_block.out1)
strings_2 = Output(code_block.out0)  # "strings"
