# Dynamo custom node UILogoPath.dyf "© UILogoPath" (Dynamo 2.3.0.5885)
# category: Crumple.Application.UI
# Returns the file path of your 'My Documents' folder, then the file 'logo.png'. If you store your logo here you can call on it reliably for Data Shapes interfaces.

refresh = Input(refresh: bool = True)
python_script = Python(IN[0]=refresh)
# ---------- python_script.python (15 lines) ----------
# Made by Gavin Crump
# Free for use
# BIM Guru, www.bimguru.com.au
# Thanks to Sean Page for suggesting the os package

# Boilerplate text
import clr
import os

user = os.environ.get('USERNAME')
fl = os.environ.get('USERPROFILE')

md = fl + "\Documents" + "\logo.png"

OUT = md
# ----------------------------------------
path = Output(python_script)
