# Dynamo custom node UserDesktop.dyf (Dynamo 2.3.0.5885)
# category: Crumple.Application
# This node returns the active username, as well as a path to the user's Desktop.

Drive = Input(Drive: string = "C")
Refresh = Input(Refresh: bool = true)
python_script = Python(IN[0]=Drive, IN[1]=Refresh)
# ---------- python_script.python (14 lines) ----------
# Made by Gavin Crump
# Free for use
# BIM Guru, www.bimguru.com.au

# Boilerplate text
import clr
from System import Environment

drive = IN[0]

user = Environment.UserName
dt = drive + ":\Users\\" + user + "\Desktop"

OUT = [user,dt]
# ----------------------------------------
code_block = CodeBlock(out=python_script) { out[0]; out[1]; }
username = Output(code_block.out0)
Desktop = Output(code_block.out1)
