# Dynamo custom node UserTemp.dyf (Dynamo 2.3.0.5885)
# category: Crumple.Application
# This node returns the active username, as well as a path to the user's Temp files.

Drive = Input(Drive: string = "C")
Refresh = Input(Refresh: bool = true)
python_script = Python(IN[0]=Drive, IN[1]=Refresh)
# ---------- python_script.python (14 lines) ----------
# Made by Gavin Crump
# Free for use
# BIM Guru, www.bimguru.com.au

# Boilerplate text
import clr
from System import Environment

drive = IN[0]
user = Environment.UserName

te = drive + ":\Users\\" + user + "\AppData\Local\Temp"

OUT = [user,te]
# ----------------------------------------
code_block = CodeBlock(out=python_script) { out[0]; out[1]; }
username = Output(code_block.out0)
Temp = Output(code_block.out1)
