# Dynamo custom node ViewFamilyTypesFamilyName.dyf "© ViewFamilyTypes.GetByViewTypeAndName" (Dynamo 2.12.1.8246)
# category: Crumple.Revit.Query
# Returns the view family type of a provided view type or view type name (of the ViewType enumeration), and name if found.
# packages: Crumple 2022.5.27

viewTypeOrName = Input(viewTypeOrName: var)
name = Input(name: string)
docOrLink = Input(docOrLink: var[]..[] = null)  # Uses current if none provided. Accepts document or link instance.
revit_getdocument = Custom[© Revit.GetDocument](docOrLink=docOrLink)  # package Crumple; If no input is specified or an invalid one is, returns current document. If a link instance is provided, it returns the linked document. If a document is provided it will pass it through.
python_script = Python(IN[0]=viewTypeOrName, IN[1]=name, IN[2]=revit_getdocument.document)  # IronPython2
# ---------- python_script.python (33 lines) ----------
# Made by Gavin Crump
# Free for use
# BIM Guru, www.bimguru.com.au

# Boilerplate text
import clr

clr.AddReference("RevitAPI")
import Autodesk 
from Autodesk.Revit.DB import *

# Define list/unwrap list functions
def tolist(input):
    result = input if isinstance(input, list) else [input]
    return result

# Inputs
vf   = str(IN[0])
fn = IN[1]
doc  = IN[2]

# Get all vfts
vfts = FilteredElementCollector(doc).OfClass(ViewFamilyType).ToElements()

vft_out = None

for v in vfts:
	if str(v.ViewFamily) == vf and Element.Name.GetValue(v) == fn:
		vft_out = v
		break

# Preparing output to Dynamo
OUT = vft_out
# ----------------------------------------
viewFamilyType = Output(python_script)
isNull = Object.IsNull(object=python_script)
not_ = Not(x=isNull)
wasFound = Output(not_)
