# Dynamo custom node ViewGetPhase.dyf "© ViewGetPhase" (Dynamo 2.3.0.5885)
# category: Crumple.Revit.Views
# Given a view or list of views, returns the phases applied to those views as elements.

view = Input(view: var[]..[])
python_script = Python(IN[0]=view)
# ---------- python_script.python (36 lines) ----------
# Made by Gavin Crump
# Free for use
# BIM Guru, www.bimguru.com.au

# Boilerplate text
import clr

clr.AddReference("RevitServices")
import RevitServices
from RevitServices.Persistence import DocumentManager 

clr.AddReference("RevitAPI")
import Autodesk 
from Autodesk.Revit.DB import *

# Current doc/app/ui
doc = DocumentManager.Instance.CurrentDBDocument

# Define list/unwrap list functions
def uwlist(input):
    result = input if isinstance(input, list) else [input]
    return UnwrapElement(result)

# Preparing input from dynamo to revit
views = uwlist(IN[0])

phases = []

# Do some action in a Transaction
for v in views:
	phaseid = v.get_Parameter(BuiltInParameter.VIEW_PHASE).AsElementId()
	phase   = v.Document.GetElement(phaseid)
	phases.append(phase)

# Preparing output to Dynamo
OUT = phases
# ----------------------------------------
phase = Output(python_script)
