# Dynamo custom node ViewTemplates.dyf "© ViewTemplates" (Dynamo 2.3.0.5885)
# category: Crumple.Revit.Selection
# Returns all view templates in the active document. Due to API/Dynamo limitations, 3D view templates are excluded from the list.

Refresh = Input(Refresh: bool = True)
python_script = Python(IN[0]=Refresh)
# ---------- python_script.python (29 lines) ----------
# Made by Gavin Crump
# Free for use
# BIM Guru, www.bimguru.com.au

# Boilerplate text
import clr

clr.AddReference("RevitServices")
import RevitServices
from RevitServices.Persistence import DocumentManager 

clr.AddReference("RevitAPI")
import Autodesk 
from Autodesk.Revit.DB import *

# Current doc/app/ui
doc = DocumentManager.Instance.CurrentDBDocument

# Get view templates
views_all = FilteredElementCollector(doc).OfClass(View).ToElements()

viewTemplates = []

for v in views_all:
	if v.IsTemplate and v.ViewType != ViewType.ThreeD:
		viewTemplates.append(v)

# Preparing output to Dynamo
OUT = viewTemplates
# ----------------------------------------
viewTemplates = Output(python_script)
