# Dynamo custom node ViewTemplatesUnused.dyf "© Collect.ViewTemplatesUnused" (Dynamo 2.12.1.8246)
# category: Crumple.Revit.Query
# Returns all view templates in the document which aren't applied to a view or view family type's default view template.
# packages: Crumple 2022.5.27

docOrLink = Input(docOrLink: var[]..[] = null)  # Uses current if none provided. Accepts document or link instance.
revit_getdocument = Custom[© Revit.GetDocument](docOrLink=docOrLink)  # package Crumple; If no input is specified or an invalid one is, returns current document. If a link instance is provided, it returns the linked document. If a document is provided it will pass it through.
python_script = Python(IN[0]=revit_getdocument.document)  # IronPython2
# ---------- python_script.python (62 lines) ----------
# Made by Gavin Crump
# Free for use
# BIM Guru, www.bimguru.com.au

# Boilerplate text
import clr

clr.AddReference("RevitAPI")
import Autodesk 
from Autodesk.Revit.DB import *

# Current doc/app/ui
doc = IN[0]

# Define list/unwrap list functions
def uwlist(input):
    result = input if isinstance(input, list) else [input]
    return UnwrapElement(result)

def objOrList(input):
    if isinstance(input, list) and len(input) == 1:
        return input[0]
    else:
        return input

# Preparing input from dynamo to revit
templateIds_all    = []
templateIds_used   = []
templates_unused   = []
templateIds_unused = []

# get all views in document
views = FilteredElementCollector(doc).OfClass(View).ToElements()
vfts  = FilteredElementCollector(doc).OfClass(ViewFamilyType).ToElements()

# get used templates by view
for v in views:
	vType = v.ViewType
	if v.IsTemplate:
		templateIds_all.append(v.Id)
	elif vType == ViewType.DrawingSheet or v.Name == "System Browser" or v.Name == "Project View":
		pass
	else:
		tid = v.ViewTemplateId.IntegerValue
		if tid not in templateIds_used and tid != -1:
			templateIds_used.append(tid)

# get used templates by viewfamilytype
for vft in vfts:
	tid = vft.DefaultTemplateId.IntegerValue
	if tid not in templateIds_used and tid != -1:
		templateIds_used.append(tid)

# Find unused templates
for vtId in templateIds_all:
	if vtId not in templateIds_used:
		templateIds_unused.append(vtId.IntegerValue)
		vt = doc.GetElement(vtId)
		templates_unused.append(vt)

# Preparing output to Dynamo
OUT = [templates_unused, templateIds_unused]
# ----------------------------------------
code_block = CodeBlock(x=python_script) { x[0]; x[1]; }
unusedTemplates = Output(code_block.out0)
elementIds = Output(code_block.out1)
