# Dynamo custom node ViewportsCreate.dyf "© Viewports.Create" (Dynamo 2.12.1.8246)
# category: Crumple.Revit.Create
# Moves views to sheets based on viewport centres. If less points than views/sheets are provided, it will use longest lacing.

views = Input(views: var[]..[])  # View/sheet count should be the same size/structure.
sheets = Input(sheets: var[]..[])  # View/sheet count should be the same size/structure.
points = Input(points: var[]..[])  # Points will match or be made to match view count.
python_script = Python(IN[0]=views, IN[1]=sheets, IN[2]=points)  # IronPython2
# ---------- python_script.python (73 lines) ----------
# Made by Gavin Crump
# Free for use
# BIM Guru, www.bimguru.com.au

# Boilerplate text
import clr

import sys
sys.path.append('C:\Program Files (x86)\IronPython 2.7\Lib')

import System
from System import Array
from System.Collections.Generic import *

clr.AddReference("RevitNodes")
import Revit
clr.ImportExtensions(Revit.Elements)
clr.ImportExtensions(Revit.GeometryConversion)

clr.AddReference("RevitServices")
import RevitServices
from RevitServices.Persistence import DocumentManager 
from RevitServices.Transactions import TransactionManager 

clr.AddReference("RevitAPI")
import Autodesk 
from Autodesk.Revit.DB import *

# Current doc/app/ui
doc = DocumentManager.Instance.CurrentDBDocument

# Function for unwrapping and forcing lists
def uwlist(input):
	tolist = input if isinstance(input, list) else [input]
	return UnwrapElement(tolist)

def listpad(lst,count):
	padded = []
	length = len(lst)
	for i in range(0,count):
		if i < length:
			padded.append(lst[i])
		else:
			padded.append(lst[-1])
	return padded

# Preparing input from dynamo to revit
views  = uwlist(IN[0])
sheets = uwlist(IN[1])
points = listpad(uwlist(IN[2]), len(views))

# Do some action in a Transaction
TransactionManager.Instance.EnsureInTransaction(doc)

viewports = []
report = []

for v,s,p in zip(views,sheets,points):

	isUnplaced = Viewport.CanAddViewToSheet(doc, s.Id, v.Id)
	
	if isUnplaced:
		report.append("")
		vp = Viewport.Create(doc, s.Id, v.Id, p.ToXyz())
		viewports.append(vp)
	else:
		report.append("View is already placed.")
		viewports.append(None)

TransactionManager.Instance.TransactionTaskDone()

# Preparing output to Dynamo
OUT = [viewports, report]
# ----------------------------------------
code_block = CodeBlock(lst=python_script) { vp = lst[0]; rp = lst[1]; }
viewports = Output(code_block.vp)  # All results, including views that failed to place. These are most likely already on a sheet.
report = Output(code_block.rp)  # A result of whether the viewport was successfully placed.  No news = good news!
