# Dynamo custom node Views.dyf "© Views" (Dynamo 2.3.1.11775)
# category: Crumple.Revit.Views
# Returns all views in the model. Excludes system views, templates, legends and schedule instances.

Refresh = Input(Refresh: bool = true)  # Toggle to refresh
python_script = Python(IN[0]=Refresh)
# ---------- python_script.python (34 lines) ----------
# Made by Gavin Crump
# Free for use
# BIM Guru, www.bimguru.com.au

# Boilerplate text
import clr

# Import RevitAPI
clr.AddReference("RevitAPI")
import Autodesk
from Autodesk.Revit.DB import *

# Import DocumentManager
clr.AddReference("RevitServices")
from RevitServices.Persistence import DocumentManager
# Get the project document.
doc = DocumentManager.Instance.CurrentDBDocument

# Get all views
Views_doc = FilteredElementCollector(doc).OfClass(View).ToElements()

# Create empty lists
View_list = []

# Find views that aren't legends, then non-template
for v in Views_doc:
	vType = v.ViewType
	if vType == ViewType.Legend or vType == ViewType.Schedule or v.IsTemplate or vType == ViewType.DrawingSheet or v.Name == "System Browser" or v.Name == "Project View":
		pass
	else:
		View_list.append(v)

# Output cleaned view lists
OUT = View_list
# ----------------------------------------
views = Output(python_script)  # All views in the current document.
