# Dynamo custom node ViewsAncestry.dyf "© Views.Ancestry" (Dynamo 2.12.1.8246)
# category: Crumple.Revit.Query
# Returns the parent of a view, and the parent of that view, and the.... etc. Will also return if it had any parents, as well as the depth of the view's family tree.

views = Input(views: var[]..[])
python_script = Python(IN[0]=views)  # CPython3
# ---------- python_script.python (63 lines) ----------
# Made by Gavin Crump
# Free for use
# BIM Guru, www.bimguru.com.au

# Boilerplate text
import clr

clr.AddReference("RevitAPI")
import Autodesk 
from Autodesk.Revit.DB import BuiltInParameter

# Define list/unwrap list functions
def uwlist(input):
    result = input if isinstance(input, list) else [input]
    return UnwrapElement(result)

def objOrList(input, initial = IN[0]):
	if isinstance(initial, list):
		return input
	else:
		return input[0]

# Preparing input from dynamo to revit
viewlist  = uwlist(IN[0])
alltrees, alldepths, hasparents = [],[],[]

BIP_PARENT = BuiltInParameter.SECTION_PARENT_VIEW_NAME

# Exhaust the lineage
for v in viewlist:
	doc = v.Document
	breaker = 0
	checkview = v
	treedepth = 1
	viewtree  = []
	godeeper = True
	while godeeper and breaker < 99:
		breaker += 1
		try:
			prmViewId = checkview.GetPrimaryViewId()
			primView  = doc.GetElement(prmViewId)
			if primView != None:
				checkview = primView
				treedepth += 1
				viewtree.append(checkview)
		except:
			pass
		try:
			parentId  = checkview.get_Parameter(BIP_PARENT).AsElementId()
			checkview = doc.GetElement(parentId)
			if checkview != None:
				treedepth += 1
				viewtree.append(checkview)
			else:
				godeeper = False
		except:
			godeeper = False
	alltrees.append(viewtree)
	alldepths.append(treedepth)
	hasparents.append(treedepth > 1)

# Preparing output to Dynamo
OUT = [objOrList(o) for o in [alltrees, alldepths, hasparents]]
# ----------------------------------------
code_block = CodeBlock(out=python_script) { out[0]; out[1]; out[2]; }
ancestry = Output(code_block.out0)
generations = Output(code_block.out1)
hasAncestry = Output(code_block.out2)
