# Dynamo custom node ViewsCleaned.dyf "© ViewsCleaned" (Dynamo 2.3.0.5885)
# category: Crumple.Revit.Selection
# Returns the views/legends contained within the current document. Legends are broken out into their own sub-list.

Refresh = Input(Refresh: bool = true)  # Toggle to refresh
python_script = Python(IN[0]=Refresh)
# ---------- python_script.python (35 lines) ----------
# Made by Gavin Crump
# Free for use
# BIM Guru, www.bimguru.com.au

# Boilerplate text
import clr

# Import RevitAPI
clr.AddReference("RevitAPI")
import Autodesk
from Autodesk.Revit.DB import *

# Import DocumentManager
clr.AddReference("RevitServices")
from RevitServices.Persistence import DocumentManager
# Get the project document.
doc = DocumentManager.Instance.CurrentDBDocument

# Get all views
Views_doc = FilteredElementCollector(doc).OfCategory(BuiltInCategory.OST_Views)

# Create empty lists
View_list   = []
Legend_list = []

# Find views that aren't legends, then non-template
for view in Views_doc:
	if str(view.GetType()) == "Autodesk.Revit.DB.View":
		Legend_list.append(view)
	else:
		if not(view.IsTemplate):
			View_list.append(view)

# Output cleaned view lists
OUT = [View_list, Legend_list]
# ----------------------------------------
code_block = CodeBlock(out=python_script) { views   = out[0]; legends = out[1]; }
Views = Output(code_block.views)  # All views in the current document.
Legends = Output(code_block.legends)  # All legends in the current document.
