# Dynamo custom node ViewsCreateDependents.dyf "© Views.CreateDependents" (Dynamo 2.3.1.11775)
# category: Crumple.Revit.Create
# Given a list of names and a view, will generate a set of dependent views upon that view with those names.

view = Input(view: var[]..[])
dependentNames = Input(dependentNames: var[]..[])
python_script = Python(IN[0]=view, IN[1]=dependentNames)
# ---------- python_script.python (67 lines) ----------
# Made by Gavin Crump
# Free for use
# BIM Guru, www.bimguru.com.au

# Boilerplate text
import clr


clr.AddReference("RevitServices")
import RevitServices
from RevitServices.Persistence import DocumentManager 
from RevitServices.Transactions import TransactionManager 

clr.AddReference("RevitAPI")
import Autodesk 
from Autodesk.Revit.DB import *

# Current doc/app/ui
doc = DocumentManager.Instance.CurrentDBDocument

# Define list/unwrap list functions
def tolist(input):
    result = input if isinstance(input, list) else [input]
    return result

def uwlist(input):
    result = input if isinstance(input, list) else [input]
    return UnwrapElement(result)

# Preparing input from dynamo to revit
view   = UnwrapElement(IN[0])
names  = tolist(IN[1])

depViews,success,outcomes = [],[],[]

# Do some action in a Transaction
TransactionManager.Instance.EnsureInTransaction(doc)

for n in names:
	
	try:
		newViewId = view.Duplicate(Autodesk.Revit.DB.ViewDuplicateOption.AsDependent)
		newView = doc.GetElement(newViewId)
		viewMade = True
	except:
		success.append(False)
		outcomes.append("Error: View cannot be created.")
		depViews.append(None)
		viewMade = False

	if viewMade:
		try:
			newView.Name = n
			depViews.append(newView)
			success.append(True)
			outcomes.append("No errors found.")
		except:
			id = newView.Id
			del_id = doc.Delete(id)
			depViews.append(None)
			success.append(False)
			outcomes.append("Error: View name already exists.")
			
TransactionManager.Instance.TransactionTaskDone()

# Preparing output to Dynamo
OUT = [depViews,success,outcomes]
# ----------------------------------------
code_block = CodeBlock(x=python_script) { x[0]; x[1]; x[2]; }
dependentViews = Output(code_block.out0)
success = Output(code_block.out1)
errorReport = Output(code_block.out2)
