# Dynamo custom node ViewsDependents.dyf "© Views.Dependents" (Dynamo 2.12.1.8246)
# category: Crumple.Revit.Query
# For a view, returns any dependent views it has as well as whether it has any.

views = Input(views: var[]..[])
python_script = Python(IN[0]=views)  # IronPython2
# ---------- python_script.python (36 lines) ----------
# Made by Gavin Crump
# Free for use
# BIM Guru, www.bimguru.com.au

# Boilerplate text
import clr

# Define list/unwrap list functions
def uwlist(input):
    result = input if isinstance(input, list) else [input]
    return UnwrapElement(result)

def objOrList(input, initial = IN[0]):
	if isinstance(initial, list):
		return input
	else:
		return input[0]

# Preparing input from dynamo to revit
viewlist = uwlist(IN[0])

childlist,haschildren = [],[]

# Do some action in a Transaction
for v in viewlist:
	doc = v.Document
	childIds = v.GetDependentViewIds()
	children = []
	for i in childIds:
		vc = doc.GetElement(i)
		children.append(vc)
	childlist.append(children)
	haschildren.append(len(children) > 0)

# Preparing output to Dynamo
OUT = objOrList(childlist), objOrList(haschildren)
# ----------------------------------------
code_block = CodeBlock(x=python_script) { x[0]; x[1]; }
dependentViews = Output(code_block.out0)
hasDependents = Output(code_block.out1)
