# Dynamo custom node ViewsLevel.dyf "© Views.Level" (Dynamo 2.3.1.11775)
# category: Crumple.Revit.Query
# Returns the associated level of a view (if it has one), as well as a boolean mask to remove views without levels after.

views = Input(views: var[]..[])  # View or list of views to return the level of.
python_script = Python(IN[0]=views)
# ---------- python_script.python (30 lines) ----------
# Made by Gavin Crump
# Free for use
# BIM Guru, www.bimguru.com.au

# Boilerplate text
import clr

clr.AddReference("RevitAPI")
import Autodesk 
from Autodesk.Revit.DB import *

# Preparing input from dynamo to revit
views_d = IN[0] if isinstance(IN[0], list) else [IN[0]]
views_r = UnwrapElement(views_d)

# Preparing empty lists
levels, bools = [], []

# Getting view level
for v in views_r:
	lvl  = v.GenLevel
	if lvl != None:
		levels.append(lvl)
		bools.append(True)
	else:
		levels.append(None)
		bools.append(False)

# Preparing output to Dynamo
OUT = [levels, bools]
# ----------------------------------------
code_block = CodeBlock(lst=python_script) { lvls = lst[0]; bols = lst[1]; }
lvls = Output(code_block.lvls)  # Levels of the views.
hasLevel = Output(code_block.bols)  # Does the view have a level.
