# Dynamo custom node ViewsOpen.dyf "© Views.Open" (Dynamo 2.12.1.8246)
# category: Crumple.Revit.Actions
# Opens a Revit view (can also be a sheet).

view = Input(view: var = Revit.Application.Document.Current.ActiveView)  # The view to place the areas in.
python_script = Python(IN[0]=view)  # IronPython2
# ---------- python_script.python (31 lines) ----------
# Made by Gavin Crump
# Free for use
# BIM Guru, www.bimguru.com.au

# Boilerplate text
import clr

clr.AddReference("RevitServices")
import RevitServices
from RevitServices.Persistence import DocumentManager
from RevitServices.Transactions import TransactionManager

# Current doc/app/ui
doc   = DocumentManager.Instance.CurrentDBDocument
uidoc = DocumentManager.Instance.CurrentUIDocument

# Begin transaction to allow viewrequest
TransactionManager.Instance.EnsureInTransaction(doc)
TransactionManager.Instance.ForceCloseTransaction()

# Change the active view
try:
	view = UnwrapElement(IN[0])
	uidoc.RequestViewChange(view)
	result = True
except:
	view = None
	result = False

# Preparing output to Dynamo
OUT = view, result
# ----------------------------------------
code_block = CodeBlock(lst=python_script) { view   = lst[0]; result = lst[1]; }
active = Output(code_block.view)  # The view that was opened
wasOpened = Output(code_block.result)  # Was the change successful?
