# Dynamo custom node ViewsParent.dyf "© Views.Parent" (Dynamo 2.12.1.8246)
# category: Crumple.Revit.Query
# For a view, return it's next related parent view if any. Will only retrieve one level above (even if it's parent has a parent etc.).

views = Input(views: var[]..[])
python_script = Python(IN[0]=views)  # IronPython2
# ---------- python_script.python (38 lines) ----------
# Boilerplate text
import clr

clr.AddReference("RevitAPI")
import Autodesk 
from Autodesk.Revit.DB import BuiltInParameter

# Define list/unwrap list functions
def uwlist(input):
    result = input if isinstance(input, list) else [input]
    return UnwrapElement(result)

def objOrList(input, initial = IN[0]):
	if isinstance(initial, list):
		return input
	else:
		return input[0]

# Preparing input from dynamo to revit
viewlist  = uwlist(IN[0])
parentlist, hasparent = [],[]

BIP_PARENT = BuiltInParameter.SECTION_PARENT_VIEW_NAME

# Do some action in a Transaction
for v in viewlist:
	doc = v.Document
	try:
		parentId = v.get_Parameter(BIP_PARENT).AsElementId()
		parentEl = doc.GetElement(parentId)
		parentlist.append(parentEl)
		hasparent.append(True)
	except:
		parentlist.append(None)
		hasparent.append(False)

# Preparing output to Dynamo
OUT = objOrList(parentlist), objOrList(hasparent)
# ----------------------------------------
code_block = CodeBlock(x=python_script) { x[0]; x[1]; }
parentView = Output(code_block.out0)
hasParent = Output(code_block.out1)
