# Dynamo custom node ViewsSetCropBox.dyf "© Views.SetCropBox" (Dynamo 2.3.0.5885)
# category: Crumple.Revit.Actions
# Given a view and one polycurve, sets the boundary of that views crop to the curves of that polycurve. Will not accept multiple polycurves or a list of curves.

views = Input(views: var[]..[])
polyCurves = Input(polyCurves: var[]..[])
showCrop = Input(showCrop: bool = false)
python_script = Python(IN[0]=views, IN[1]=polyCurves, IN[2]=showCrop)
# ---------- python_script.python (69 lines) ----------
# Made by Gavin Crump
# Free for use
# BIM Guru, www.bimguru.com.au

# Boilerplate text
import clr

clr.AddReference('ProtoGeometry')
from Autodesk.DesignScript.Geometry import *

clr.AddReference("RevitNodes")
import Revit
clr.ImportExtensions(Revit.Elements)
clr.ImportExtensions(Revit.GeometryConversion)

clr.AddReference("RevitServices")
import RevitServices
from RevitServices.Persistence import DocumentManager 
from RevitServices.Transactions import TransactionManager 

clr.AddReference("RevitAPI")
import Autodesk 
from Autodesk.Revit.DB import *

# Current doc/app/ui
doc = DocumentManager.Instance.CurrentDBDocument

# Define list/unwrap list functions
def tolist(input):
    result = input if isinstance(input, list) else [input]
    return result

def uwlist(input):
    result = input if isinstance(input, list) else [input]
    return UnwrapElement(result)

# Preparing input from dynamo to revit
views   = uwlist(IN[0])
pcurves = tolist(IN[1])
visible = IN[2]

viewout = []

# Deconstruct curves and set the view crops
for v,pc in zip(views,pcurves):

	regionManager = v.GetCropRegionShapeManager()
	
	curves_pc = PolyCurve.Curves(pc)
	curves_rv = [c.ToRevitType() for c in curves_pc]
	
	curveloop = Autodesk.Revit.DB.CurveLoop()
	for c in curves_rv:
		curveloop.Append(c)

	TransactionManager.Instance.EnsureInTransaction(doc)
	
	v.CropBoxVisible = visible
	if v.CropBoxActive == False:
		v.CropBoxActive  = True
	
	regionManager.SetCropShape(curveloop)
	
	TransactionManager.Instance.TransactionTaskDone()
	
	viewout.append(v)

# Preparing output to Dynamo
OUT = viewout
# ----------------------------------------
views_2 = Output(python_script)  # "views"
