# Dynamo custom node ViewsSheet.dyf "© Views.Sheet" (Dynamo 2.12.1.8246)
# category: Crumple.Revit.Query
# Returns the first sheet a view is found on, if any.

views = Input(views: var[]..[])  # View or list of views.
python_script = Python(IN[0]=views)  # IronPython2
# ---------- python_script.python (45 lines) ----------
# Made by Gavin Crump
# Free for use
# BIM Guru, www.bimguru.com.au

# Boilerplate text
import clr

clr.AddReference("RevitServices")
import RevitServices
from RevitServices.Persistence import DocumentManager 

clr.AddReference("RevitAPI")
import Autodesk 
from Autodesk.Revit.DB import *

# Current doc/app/ui
doc = DocumentManager.Instance.CurrentDBDocument

sheets = FilteredElementCollector(doc).OfClass(ViewSheet).ToElements()
sheetNums = [s.SheetNumber for s in sheets]

# Define list/unwrap list functions
def uwlist(input):
    result = input if isinstance(input, list) else [input]
    return UnwrapElement(result)

# Preparing input from dynamo to revit
views = uwlist(IN[0])

# Get data
view_sheets, view_sheeted = [],[]

for v in views:
	try:
		par = v.LookupParameter("Sheet Number")
		val = par.AsString()
		ind = sheetNums.index(val)
		view_sheets.append(sheets[ind])
		view_sheeted.append(True)
	except:
		view_sheets.append(None)
		view_sheeted.append(False)

# Preparing output to Dynamo
OUT = view_sheets, view_sheeted
# ----------------------------------------
code_block = CodeBlock(x=python_script) { x[0]; x[1]; }
sheet = Output(code_block.out0)
isOnSheet = Output(code_block.out1)
