# Dynamo custom node WaitFor.dyf (Dynamo 2.3.0.5885)
# category: Crumple.Script.Flow
# Tells the first input to wait for the second input to arrive, then passes on the first input. Really useful for scripts which have branching paths that rely on their outputs to carry each other forward.
# Quite a few custom packages have a 'passthrough' or 'waitfor' node. I use these all the time, so find it useful to have them contained in this package also.

data = Input(data: var[]..[])
waitFor = Input(waitFor: var[]..[])
code_block = CodeBlock(data=data, waitfor=waitFor) { [data,waitfor][0]; }
data_2 = Output(code_block)  # "data"
