# Dynamo custom node WarningsRelatedElements.dyf "© Warnings.RelatedElements" (Dynamo 2.3.1.11775)
# category: Crumple.Revit.Query
# Returns the element(s) associated with the provided warning.
# packages: Crumple 2022.2.13

warning = Input(warning: var[]..[])
docOrLink = Input(docOrLink: var[]..[] = null)  # Uses current if none provided. Accepts document or link instance.
revit_getdocument = Custom[© Revit.GetDocument](docOrLink=docOrLink)  # package Crumple; If no input is specified or an invalid one is, returns current document. If a link instance is provided, it returns the linked document. If a document is provided it will pass it through.
python_script = Python(IN[0]=warning, IN[1]=revit_getdocument.document)
# ---------- python_script.python (28 lines) ----------
# Made by Gavin Crump
# Free for use
# BIM Guru, www.bimguru.com.au

# Boilerplate text
import clr

# Current doc/app/ui
doc = IN[1]

# Define list/unwrap list functions
def uwlist(input):
    result = input if isinstance(input, list) else [input]
    return UnwrapElement(result)

# Preparing input from dynamo to revit
warnings  = uwlist(IN[0])

failingIds, failingElements = [],[]

# Get messages
for w in warnings:
	ids = w.GetFailingElements()
	elements = [doc.GetElement(i) for i in ids]
	failingElements.append(elements)

# Preparing output to Dynamo
OUT = failingElements
# ----------------------------------------
elements = Output(python_script)
