# Dynamo custom node WindowsFileSize.dyf "© Windows.FileSize" (Dynamo 2.16.2.5624)
# category: Crumple.Application.Query
# Returns the size of a file path in MB.

filePaths = Input(filePaths: var[]..[])
python_script = Python(IN[0]=filePaths)  # CPython3
# ---------- python_script.python (32 lines) ----------
# Made by Gavin Crump
# Free for use
# BIM Guru, www.bimguru.com.au

# Boilerplate text
import clr
import os

# Define list/unwrap list functions
def tolist(input):
    result = input if isinstance(input, list) else [input]
    return result

def objOrList(input, initial = IN[0]):
	if isinstance(initial, list):
		return input
	else:
		return input[0]

def getFileSize(filePath):
    try:
        size = os.path.getsize(filePath)
        return size / 1000000
    except:
        return None

# Method from Data-Shapes to get current model size
filePaths = tolist(IN[0])
sizes = [getFileSize(fp) for fp in filePaths]

# Return size in MB
OUT = objOrList(sizes)
# ----------------------------------------
sizesInMb = Output(python_script)  # Returned in MB
