# Dynamo custom node WindowsUserFolder.dyf "© Windows.UserFolder" (Dynamo 2.3.0.5885)
# category: Crumple.Application.Query
# This node return's the active username, as well as a path to their user folder.

Refresh = Input(Refresh: bool = true)  # Toggle to refresh
python_script = Python(IN[0]=Refresh)
# ---------- python_script.python (13 lines) ----------
# Made by Gavin Crump
# Free for use
# BIM Guru, www.bimguru.com.au
# Thanks to Sean Page for suggesting the os package

# Boilerplate text
import clr
import os

user = os.environ.get('USERNAME')
fl = os.environ.get('USERPROFILE')

OUT = [user,fl]
# ----------------------------------------
code_block = CodeBlock(out=python_script) { out[0]; out[1]; }
username = Output(code_block.out0)  # The active user's name
folder = Output(code_block.out1)  # The active user's user folder
