# Dynamo custom node WindowsUserPaths.dyf "© Windows.UserPaths" (Dynamo 2.12.1.8246)
# category: Crumple.Application.Query
# This node returns the active username, as well as common user paths including:
# - Desktop
# - My Documents
# - Temp
# - Dynamo Revit (for active build)
# - Dynamo Revit logs (" ")

refresh = Input(refresh: bool = true)  # Toggle to refresh
python_script = Python(IN[0]=refresh)  # CPython3
# ---------- python_script.python (17 lines) ----------
# Made by Gavin Crump
# Free for use
# BIM Guru, www.bimguru.com.au
# Thanks to Sean Page for suggesting the os package

# Boilerplate text
import clr
import os

user = os.environ.get('USERNAME')
fl = os.environ.get('USERPROFILE')

dt = fl + "\Desktop"
md = fl + "\Documents"
te = fl + "\AppData\Local\Temp"

OUT = [user,fl,dt,md,te]
# ----------------------------------------
code_block = CodeBlock(out=python_script) { out[0]; out[1]; out[2]; out[3]; out[4]; }
username = Output(code_block.out0)  # The active user's name
userFolder = Output(code_block.out1)  # The active user's user folder path
desktop = Output(code_block.out2)  # The active user's Desktop path
userDocuments = Output(code_block.out3)  # The active user's My Documents path
tempFiles = Output(code_block.out4)  # The active user's Temporary Files path
