# Dynamo custom node Worksets.dyf "© Worksets" (Dynamo 2.3.0.5885)
# category: Crumple.Revit.Selection
# Returns all user worksets and their names in the current document.

refresh = Input(refresh: bool = false)  # Toggle to refresh
python_script = Python(IN[0]=refresh)
# ---------- python_script.python (30 lines) ----------
# Made by Gavin Crump
# Free for use
# BIM Guru, www.bimguru.com.au

# Boilerplate text
import clr
clr.AddReference("RevitServices")
import RevitServices
from RevitServices.Persistence import DocumentManager 
clr.AddReference("RevitAPI")
import Autodesk 
from Autodesk.Revit.DB import *

# Current doc/app/ui
doc = DocumentManager.Instance.CurrentDBDocument

# Collect all worksets
collector = FilteredWorksetCollector(doc)
worksets  = collector.OfKind(WorksetKind.UserWorkset).ToWorksets()

# Ensure iterable
if not hasattr(worksets, "__iter__"):
    worksets = [worksets]

# Get Workset names
names = []
[names.append(w.Name) for w in worksets]

# Output
OUT = [worksets, names]
# ----------------------------------------
code_block = CodeBlock(x=python_script) { worksets = x[0]; names    = x[1]; }
worksets = Output(code_block.worksets)  # User worksets
names = Output(code_block.names)  # User workset names (as strings).
