# Dynamo custom node WorksetsCreate.dyf "© Worksets.Create" (Dynamo 2.3.0.5885)
# category: Crumple.Revit.Create
# Attempts to create worksets given a provided name. Will return whether it was successful in each case, as well as the new workset's Id where it was (and a null where it wasn't).

name = Input(name: var[]..[])
python_script = Python(IN[0]=name)
# ---------- python_script.python (46 lines) ----------
# Made by Gavin Crump
# Free for use
# BIM Guru, www.bimguru.com.au

# Boilerplate text
import clr

clr.AddReference("RevitServices")
import RevitServices
from RevitServices.Persistence import DocumentManager 
from RevitServices.Transactions import TransactionManager 

clr.AddReference("RevitAPI")
import Autodesk 
from Autodesk.Revit.DB import *

# Current doc/app/ui
doc = DocumentManager.Instance.CurrentDBDocument

# Define list/unwrap list functions
def tolist(input):
    result = input if isinstance(input, list) else [input]
    return result

# Preparing input from dynamo to revit
names = tolist(IN[0])
worksets,ids,bools = [],[],[]

# Do some action in a Transaction
TransactionManager.Instance.EnsureInTransaction(doc)

for n in names:
	try:
		w_r = Workset.Create(doc, n)
		worksets.append(w_r)
		ids.append(w_r.Id.IntegerValue)
		bools.append(True)
	except:
		worksets.append(None)
		ids.append(None)
		bools.append(False)

TransactionManager.Instance.TransactionTaskDone()

# Preparing output to Dynamo
OUT = [worksets,ids,bools]
# ----------------------------------------
code_block = CodeBlock(out=python_script) { wkst  = out[0]; ids   = out[1]; bools = out[2]; }
workset = Output(code_block.wkst)
id = Output(code_block.ids)
success = Output(code_block.bools)
