# Dynamo custom node WorksetsRename.dyf "© Worksets.Rename" (Dynamo 2.3.0.5885)
# category: Crumple.Revit.Actions
# Will attempt to rename a workset to a newly provided name. If the workset cannot be renamed, a null value will be returned as well as a success report.

workset = Input(workset: var[]..[])
name = Input(name: var[]..[])
python_script = Python(IN[0]=workset, IN[1]=name)
# ---------- python_script.python (51 lines) ----------
# Made by Gavin Crump
# Free for use
# BIM Guru, www.bimguru.com.au

# Boilerplate text
import clr

clr.AddReference("RevitNodes")
import Revit
clr.ImportExtensions(Revit.Elements)
clr.ImportExtensions(Revit.GeometryConversion)

clr.AddReference("RevitAPI")
import Autodesk 
from Autodesk.Revit.DB import *

clr.AddReference('RevitServices')
import RevitServices
from RevitServices.Persistence import DocumentManager
from RevitServices.Transactions import TransactionManager

# Define list/unwrap list functions
def tolist(input):
    result = input if isinstance(input, list) else [input]
    return result

def uwlist(input):
    result = input if isinstance(input, list) else [input]
    return UnwrapElement(result)

# Current doc/app/ui
doc = DocumentManager.Instance.CurrentDBDocument

# Preparing input from dynamo to revit
wkst_ele = uwlist(IN[0])
wkst_nam = tolist(IN[1])

# Do some action in a Transaction
TransactionManager.Instance.EnsureInTransaction(doc)

wksts,bools = [],[]

for w,n in zip(wkst_ele, wkst_nam):
	WorksetTable.RenameWorkset(doc,w.Id,n)
	wksts.append(w)
	bools.append(w.Name == n)
	
TransactionManager.Instance.TransactionTaskDone()

# Preparing output to Dynamo
OUT = [wksts,bools]
# ----------------------------------------
code_block = CodeBlock(data=python_script) { wksts = data[0]; bools = data[1]; }
workset_2 = Output(code_block.wksts)  # "workset"
success = Output(code_block.bools)
