# Dynamo graph Crumple_OpenFromProject.dyn (Dynamo 2.12.1.8246)
# packages: Crumple 2024.3.1

collect_families = Custom[© Collect.Families]()  # package Crumple; Returns all families in the document. Families are sorted into user created, inplace and internal.
code_block = CodeBlock { 20; }
takeItems = List.TakeItems(list=collect_families.userCreated, amount=code_block)
family_editdocument = Custom[© Family.EditDocument](families=takeItems)  # package Crumple; Attempts to edit (open) a copy of a family in the project as a background document.
filterByBoolMask = List.FilterByBoolMask(list=family_editdocument.familyDocs, mask=family_editdocument.wasEdited)
familydoc_getparameters = Custom[© FamilyDoc.GetParameters](familyDocs=filterByBoolMask.in)  # package Crumple; Given a family document or list of them, returns all parameters and their properties in those documents. You can provide optionally provide parameter names to get just those parameters.
familydoc_removeparameters = Custom[© FamilyDoc.RemoveParameters](familyDocs=familydoc_getparameters.familyDocs, nameOrParamLists=familydoc_getparameters.parameterLists)  # package Crumple; Given a family document or list of them, attempts to remove parameters in them. Input structures should be in the form of one sub-list per family document, in a list (but the node will try to create this data structure if not, as well as repeat the last list if they are shorter than the family document list).
familydoc_loaddocuments = Custom[© FamilyDoc.LoadDocuments](familyDocs=familydoc_removeparameters.familyDocs)  # package Crumple; Given a family document or list of them, attempts to load them to a target document. Note that this node does not close the documents, so follow this task up with a Close node if you want to close them after.
flow_waitfor = Custom[© Flow.WaitFor](data=filterByBoolMask.in, waitFor=familydoc_loaddocuments.families)  # package Crumple; Tells the first input to wait for the second input to arrive, then passes on the first input. Really useful for scripts which have branching paths that rely on their outputs to carry each other forward. Quite a few custom packages have a 'passthrough' or 'waitfor' node. I use these all the time, so find it useful to have them contained in this package also.
familydoc_closewithoutsave = Custom[© FamilyDoc.CloseWithoutSave](familyDocs=flow_waitfor)  # package Crumple; Attempts to close a family document or list of family documents, without saving them.
familydoc_title = Custom[© FamilyDoc.Title](familyDocs=family_editdocument.familyDocs)  # package Crumple; Returns the title of a family document in the unwrapped state. Can be used in conjunction with nodes like 'FamilyDocOpen'.
watch = Watch(familydoc_title)
watch_2 = Watch(familydoc_removeparameters.resultLists)
