# Dynamo custom node ListKickFlip.dyf (Dynamo 2.3.0.5885)
# category: Crumple.List
# Drops a certain number of rows from the front a list, then transposes it. Handy for pre-processing Excel data!

Lst = Input(Lst: var[]..[])
Drop = Input(Drop: int = 1)
code_block = CodeBlock(list=Lst, amount=Drop) { data = DSCore.List.DropItems(list, amount); data_t = DSCore.List.Transpose(data); }
Result = Output(code_block.data_t)
